# Grasshopper definition BUA_example_1_Load_Buildings.gh (Grasshopper 1.0.7)
# plug-ins: LadybugGrasshopper

# ----
# Load Sample files
falsestart = LBFalseStartToggle(False)
getsampledataforexamplefile = BUAGetSampleDataForExampleFile(run=falsestart)  # -> out, path_sample_gis, path_sample_epw_file, path_sample_folder_hbjson, path_sample_hbjson_list, sample_hb_model_list; inputs run: Boolean
# ---------- getsampledataforexamplefile: Python ----------
"""Get the path to sample data from the library folder
    Inputs:
        _run : Plug in a boolean toggle to run the component and load the samples
    Output:
        path_sample_gis : list of the gis file in the library folder
        path_sample_epw_file : list of the path to the epw files
        path_sample_folder_hbjson : path to the folder containing the hbjon files
        path_sample_hbjson_list : list of the path to the honeybee json files
        sample_hb_model_list : list of the path to the honeybee models"""

__author__ = "elie-medioni"
__version__ = "2024.05.27"

from ghpythonlib.componentbase import executingcomponent as component


ghenv.Component.Name = "BUA Get Sample Data For Example File"
ghenv.Component.NickName = 'GetSampleDataForExampleFile'
ghenv.Component.Message = '1.1.0'
ghenv.Component.Category = 'BUA'
ghenv.Component.SubCategory = '7 :: General'

import os

from honeybee.model import Model

if _run:
    # Get Appdata\local folder
    local_appdata = os.environ['LOCALAPPDATA']
    path_tool = os.path.join(local_appdata, "Building_urban_analysis")
    path_data_libraries_samples = os.path.join(path_tool, "Libraries","Samples_for_example_file")

    # Get the list of the gis files
    path_gis_folder = os.path.join(path_data_libraries_samples, "gis")
    path_sample_gis = [os.path.join(path_gis_folder, gis_file_name) for gis_file_name in os.listdir(path_gis_folder)][0]

    # Get the epw files
    path_epw_folder = os.path.join(path_data_libraries_samples, "epw")
    path_sample_epw_file = [os.path.join(path_epw_folder, epw_file_name) for epw_file_name in os.listdir(path_epw_folder)][0]

    # Get the hbjson files
    path_sample_folder_hbjson = os.path.join(path_data_libraries_samples, "hbjson_models")
    path_sample_hbjson_list = [os.path.join(path_sample_folder_hbjson, hbjson_file_name) for hbjson_file_name in
                        os.listdir(path_sample_folder_hbjson)]

    # Get the hb models
    sample_hb_model_list = [Model.from_hbjson(path_hbjson) for path_hbjson in path_sample_hbjson_list]
# ---------- end getsampledataforexamplefile ----------

# ----
# Load BuildingBasics from GIS
path_to_user_simulation_folder = Panel()
list = ValueList({"user simulation folder": 0, "default simulation folder": 1}, selected="default simulation folder")
addgisattributekeys = BUAAddGISAttributeKeys()  # -> report, gis_attribute_key_dict; inputs name: list, age: list, typology: list, elevation: list, height: list, number_of_floor: list, group: list
# ---------- addgisattributekeys: Python ----------
"""Add  additional keys to load GIS attributes. GIS files can use different keys to store the same information (height, elevation...). This component allows you to add additional keys to the GIS attributes. Not all attributes need to be added as default value will be used if they cannot be extracted from the GIS, but certain attributes, such as the elevation, the height or the number can have a significant impact on the simulation results and it is recommended to add teh proper keys to extract them. It is mandatory to provide the key to identify the building ID in the GIS file. If this attribute does not exist add one manually in the GIS file with the QGIS software for instance. Only use GIS that use attributes keys and values with latin alphabet characters. Using other alphabets can lead to errors.
     Inputs:
        _building_id_key_gis: Key to identify the building ID in the GIS file.
        name_: List of keys to identify the name of the building in the GIS file. Keys already included: ["name", "full_name_"]
        age_: List of keys to identify the age of the building in the GIS file. Keys already included: ["age", "date", "year"]
        typology_: List of keys to identify the typology of the building in the GIS file. Keys already included: ["typo","typology","type","Typology"]
        elevation_: List of keys to identify the elevation of the building in the GIS file. Keys already included: ["minheight"]
        height_: List of keys to identify the height of the building in the GIS file. Keys already included: ["height", "Height","govasimple"]
        number_of_floor_: List of keys to identify the number of floors of the building in the GIS file. Keys already included: ["number_floor", "nb_floor", "mskomot"]
        group_: List of keys to identify the group of the building in the GIS file. Keys already included: ["group"]
    Output:
        gis_attribute_key_dict: Dictionary containing the additional keys to load GIS attributes.
"""

__author__ = "elie-medioni"
__version__ = "2024.03.31"

ghenv.Component.Name = "BUA Add GIS Attribute Keys"
ghenv.Component.NickName = 'AddGISAttributeKeys'
ghenv.Component.Category = 'BUA'
ghenv.Component.SubCategory = '1 :: Load Buildings'
ghenv.Component.AdditionalHelpFromDocStrings = "1"

import json

# Initialize the replacement scenario parameter dictionary
gis_attribute_key_dict = {
    "building_id_key_gis": None,
    "name": [],
    "age": [],
    "typology": [],
    "elevation": [],
    "height": [],
    "number of floor": [],
    "group": []
}

# Check the _building_id_key_gis
if _building_id_key_gis is not None:
    gis_attribute_key_dict["building_id_key_gis"] = _building_id_key_gis
# Check the name_
if name_ is not None:
    gis_attribute_key_dict["name"] = name_
# Check the age_
if age_ is not None:
    gis_attribute_key_dict["age"] = age_
# Check the typology_
if typology_ is not None:
    gis_attribute_key_dict["typology"] = typology_
# Check the elevation_
if elevation_ is not None:
    gis_attribute_key_dict["elevation"] = elevation_
# Check the height_
if height_ is not None:
    gis_attribute_key_dict["height"] = height_
# Check the number_of_floor_
if number_of_floor_ is not None:
    gis_attribute_key_dict["number of floor"] = number_of_floor_
# Check the group_
if group_ is not None:
    gis_attribute_key_dict["group"] = group_

gis_attribute_key_dict = json.dumps(gis_attribute_key_dict)
# ---------- end addgisattributekeys ----------
filter = StreamFilter(Gate=list, Stream0=path_to_user_simulation_folder)
load_gis_in_urban_canopy = Button()
list_2 = ValueList({"GIS in meter": "m", "GIS in degree": "deg"}, selected="GIS in degree")
loadgisinurbancanopy = BUALoadGISInUrbanCanopy(
    path_simulation_folder=filter,
    path_gis=getsampledataforexamplefile.path_sample_gis,
    unit_gis=list_2,
    gis_attribute_keys_dict=addgisattributekeys.gis_attribute_key_dict,
    move_to_origin=Toggle(True),
    run=load_gis_in_urban_canopy)  # -> report, path_simulation_folder; inputs run: Boolean
# ---------- loadgisinurbancanopy: Python ----------
"""Load buildings from GIS in the Urban Canopy
    Inputs:
        path_simulation_folder_: Path to the folder the simulation will run. By default, the code will run in
                                Appdata\Local\Building_urban_analysis\Simulation_temp
        _path_gis : Path to the folder containing the GIS files (shp...) to load
        _unit_gis_ : Unit of the GIS file, meter ("m")  or degree ("deg"). By default set to meter
        _gis_attribute_keys_dict_ : Connect the component Add GIS Attribute Keys, to add labels for heights,
            number of floors etc. that are not considered by default by the code and that are specific to the
            GIS file you are using.
        move_to_origin_ : Center the urban canopy and its buildings on the origin of the coordinate system
        _run : Add and press a button to run the code
    Output:
        report: Logs
        path_simulation_folder_: Path to the simulation folder to pass down to the next components"""

ghenv.Component.Name = "BUA Load GIS in Urban Canopy"
ghenv.Component.NickName = 'LoadGISInUrbanCanopy'
ghenv.Component.Category = 'BUA'
ghenv.Component.SubCategory = '1 :: Load Buildings'
ghenv.Component.AdditionalHelpFromDocStrings = "1"

import os
import json
import shutil


def clean_path(path):
    path = path.replace("\\", "/")
    return (path)


def read_logs(path_simulation_folder):

    path_log_file = os.path.join(path_simulation_folder_, "gh_components_logs",
                                 ghenv.Component.NickName + ".log")
    if os.path.isfile(path_log_file):
        with open(path_log_file, 'r') as log_file:
            log_data = log_file.read()
        return (log_data)
    else:
        return ("No log file found")

# Get Appdata\local folder
local_appdata = os.environ['LOCALAPPDATA']
path_tool = os.path.join(local_appdata, "Building_urban_analysis")
path_bat_file = os.path.join(path_tool, "Scripts", "mains_tool", "run_BUA.bat")
name_folder_temporary_files = "temporary_files"

# set default value for the simulation folder if not provided

if path_simulation_folder_ is None:
    path_simulation_folder_ = os.path.join(path_tool, "Simulation_temp")
else:
     clean_path(path_simulation_folder_)

# Check GIS attribute keys dictionary
if _gis_attribute_keys_dict_ is not None:
    try:  # try to load the json
        gis_attribute_keys_dict = json.loads(_gis_attribute_keys_dict_)
    except:
        raise ValueError("The GIS attribute keys dictionary is not a valid JSON dictionnary, please use the output of the Add GIS Attribute Keys component")
    mandatory_keys = ["building_id_key_gis", "name", "age", "typology", "elevation", "height", "number of floor", "group"]
    for key in mandatory_keys:
        if key not in gis_attribute_keys_dict:
            raise ValueError("The GIS attribute keys dictionary is missing the key '{}'".format(key))
else:
    gis_attribute_keys_dict = None


if _run:
    # if there are additionnal keys for GIS attributes, make a json file containing the values
    if gis_attribute_keys_dict is not None:
        # Make the simulation folder as it might not exist yet
        command = path_bat_file + " --make_simulation_folder 1 --create_or_load_urban_canopy_object 1 -f " + path_simulation_folder_
        output = os.system(command)
        # Make the json file in the temporary folder in the simulation folder
        path_gis_attribute_keys_dict = os.path.join(path_simulation_folder_, name_folder_temporary_files, "gis_attribute_keys_dict.json")
        with open(path_gis_attribute_keys_dict, 'w') as json_file:
            json.dump(gis_attribute_keys_dict, json_file)
    else:
        path_gis_attribute_keys_dict = None  # Default value
    # Write the command
    command = path_bat_file
    argument = " "  # Initialize the argument
    # Steps to execute
    argument = argument + "--make_simulation_folder 1 " + "--create_or_load_urban_canopy_object 1 " + "--extract_gis 1 " + "--save_urban_canopy_object_to_pickle 1 " + " --save_urban_canopy_object_to_json 1 "
    # OPtionnal argument of the bat file/Python script
    if _path_gis is not None:
        argument = argument + ' -g "{}"'.format(_path_gis)
    if path_simulation_folder_ is not None:
        argument = argument + ' -f "{}"'.format(path_simulation_folder_)
    if path_gis_attribute_keys_dict is not None:
        argument = argument + ' -d "{}"'.format(path_gis_attribute_keys_dict)
    if _unit_gis_ is not None:
        argument = argument + ' -u "{}"'.format(_unit_gis_)
    if move_to_origin_ is not None:
        argument = argument + ' --move_buildings_to_origin "{}"'.format(int(move_to_origin_))
    # Add the name of the component to the argument
    argument = argument + " -c {}".format(ghenv.Component.NickName)
    # Run the bat file
    output = os.system(command + argument)

    # delete json file with the additionnal GIS attributes
    if path_gis_attribute_keys_dict is not None and os.path.exists(path_gis_attribute_keys_dict):
        os.remove(path_gis_attribute_keys_dict)

report = read_logs(path_simulation_folder_)
# ---------- end loadgisinurbancanopy ----------

# ----
# Empty Default Simulation Folder
button = Button()
cleandefaultsimulationfolder = BUACleanDefaultSimulationFolder(run=button)
# ---------- cleandefaultsimulationfolder: Python ----------
"""Clean the default simulation folder.
    Inputs:
        _run: Set to True to run the component"""

__author__ = "Eliewiii"
__version__ = "2024.05.15"

ghenv.Component.Name = "BUA Clean Default Simulation Folder"
ghenv.Component.NickName = 'CleanDefaultSimulationFolder'
ghenv.Component.Message = '1.0.0'
ghenv.Component.Category = 'BUA'
ghenv.Component.SubCategory = '7 :: General'


import shutil
import os

local_appdata = os.environ['LOCALAPPDATA']
path_tool = os.path.join(local_appdata, "Building_urban_analysis")
path_simulation_temp_folder = os.path.join(path_tool, "Simulation_temp")

if _run:
    if os.path.isdir(path_simulation_temp_folder):
        shutil.rmtree(path_simulation_temp_folder)
    os.makedirs(path_simulation_temp_folder)
# ---------- end cleandefaultsimulationfolder ----------

# ----
# Plot Building Envelopes
plot_gis_building_envelop = LBFalseStartToggle(False)
loadbuildingenvelopes = BUALoadBuildingEnvelopes(path_simulation_folder=loadgisinurbancanopy.path_simulation_folder, run=plot_gis_building_envelop)  # -> building_hb_rooms, target_building_modeled_envelopes, non_target_building_modeled_envelopes, building_basic_envelopes; inputs building_id_list: list, run: Boolean
# ---------- loadbuildingenvelopes: Python ----------
"""Plot the buildings inside the Urban Canopy.
    Inputs:
        path_simulation_folder_: Path to the folder. By default, the code will be run in
                                Appdata\Local\Building_urban_analysis\Simulation_temp
        building_id_list_: List of building ids to display. If empty, all the buildings will be displayed.
        _run : True if we want to run the code
    Output:
        target_building_modeled_envelopes : Brep of the envelopes of the target BuildingModeled
        non_target_building_modeled_envelopes : Brep of the envelopes of the non-target BuildingModeled
        building_basic_envelopes : Brep of the envelopes of the BuildingBasic
        building_hb_rooms : list of the HB rooms of representing the envelopes of buildings, can be used
            to display the ids of the buildings
"""

__author__ = "Elie"
__version__ = "2024.05.26"

from ghpythonlib.componentbase import executingcomponent as component

ghenv.Component.Name = "BUA Load Building Envelopes"
ghenv.Component.NickName = 'LoadBuildingEnvelopes'
ghenv.Component.Message = '1.1.0'
ghenv.Component.Category = 'BUA'
ghenv.Component.SubCategory = '2 :: Information'

import json
import os

from honeybee.room import Room

from ladybug_rhino.fromgeometry import from_polyface3d


def clean_path(path):
    path = path.replace("\\", "/")
    return (path)


# Get Appdata\local folder
local_appdata = os.environ['LOCALAPPDATA']
path_tool = os.path.join(local_appdata, "Building_urban_analysis")

# set default value for the simulation folder if not provided
if path_simulation_folder_ is None:
    path_simulation_folder_ = os.path.join(path_tool, "Simulation_temp")

path_json = os.path.join(path_simulation_folder_, "urban_canopy.json")

if _run and os.path.isfile(path_json):

    with open(path_json, "r") as f:
        urban_canopy_dict = json.load(f)

    # Get the list of the building ids to display
    if building_id_list_ == [] or building_id_list_ is None:
        building_id_list_ = list(urban_canopy_dict["buildings"].keys())
    else:  # Check if the building ids are in the json file
        for building_id in building_id_list_:
            try:
                urban_canopy_dict["buildings"][building_id]
            except KeyError:
                raise KeyError("Building with ID '{}' not found in the dictionary.".format(building_id))

    # Initialize the lists
    target_building_modeled_id_list = []
    non_target_building_modeled_id_list = []
    building_basic_id_list = []

    # Get the list of the target, simulated and context buildings
    for building_id in building_id_list_:
        if urban_canopy_dict["buildings"][building_id]["type"] == "BuildingModeled":
            if urban_canopy_dict["buildings"][building_id]["is_target_building"] == True:
                target_building_modeled_id_list.append(building_id)
            else :
                non_target_building_modeled_id_list.append(building_id)
        else:
            building_basic_id_list.append(building_id)

    target_building_modeled_envelopes = []
    non_target_building_modeled_envelopes = []
    building_basic_envelopes = []

    building_hb_rooms = [Room.from_dict(urban_canopy_dict["buildings"][building_id]["hb_room_envelope"]) for
                         building_id in building_id_list_]

    for building_id in target_building_modeled_id_list:
        building_hb_room_envelopes = Room.from_dict(
            urban_canopy_dict["buildings"][building_id]["hb_room_envelope"])
        target_building_modeled_envelopes.append(from_polyface3d(building_hb_room_envelopes.geometry))
    for building_id in non_target_building_modeled_id_list:
        building_hb_room_envelopes = Room.from_dict(
            urban_canopy_dict["buildings"][building_id]["hb_room_envelope"])
        non_target_building_modeled_envelopes.append(from_polyface3d(building_hb_room_envelopes.geometry))
    for building_id in building_basic_id_list:
        building_hb_room_envelopes = Room.from_dict(
            urban_canopy_dict["buildings"][building_id]["hb_room_envelope"])
        building_basic_envelopes.append(from_polyface3d(building_hb_room_envelopes.geometry))

if not os.path.isfile(path_json):
    print("the json file of the urban canopy does not exist")
# ---------- end loadbuildingenvelopes ----------
roomattr = HBRoomAttributes({"Display Name": "display_name", "Simulation Name (Identifier)": "identifier", "Multiplier": "multiplier", "Floor Area Excluded": "exclude_floor_area", "Story": "story", "Volume": "volume", "Gross Floor Area": "floor_area", "Exposed Area": "exposed_area", "Exterior Wall Area": "exterior_wall_area", "Exterior Aperture Area": "exterior_aperture_area", "Average Floor Elevation": "average_floor_height"}, selected="Display Name")
brep = Brep(loadbuildingenvelopes.non_target_building_modeled_envelopes)
brep_2 = Brep(loadbuildingenvelopes.building_basic_envelopes)
brep_3 = Brep(loadbuildingenvelopes.target_building_modeled_envelopes)

labelrooms = HBLabelRooms(rooms_model=flatten(loadbuildingenvelopes.building_hb_rooms), attribute=roomattr)  # -> label_text, base_pts, labels, wire_frame; plug-in component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
preview = CustomPreview(Geometry=brep_3, Material=ColourSwatch(SwatchColor=RGBA(73, 214, 162, 133)))
preview_2 = CustomPreview(Geometry=brep, Material=ColourSwatch(SwatchColor=RGBA(227, 127, 127, 133)))
preview_3 = CustomPreview(Geometry=brep_2, Material=ColourSwatch(SwatchColor=RGBA(181, 181, 181, 133)))

# ----
# Load BuildingBasic from Closed Breps
save_brep_to_json = LBFalseStartToggle(False)
your_brep_geometry = Brep()
convertbrepstopolyface3djson = BUAConvertBrepsToPolyface3DJson(close_brep_list=flatten(your_brep_geometry), prefix="from_brep", file_name="geometry_from_brep", run=save_brep_to_json)  # -> out, path_polyface3d_json_file; inputs close_brep_list: list of Brep, run: Boolean
# ---------- convertbrepstopolyface3djson: Python ----------
"""Convert a list of closed breps to Laadybug geometry Polyface3D object stored in a json file (mostly to send them to the urban canopy)
    Inputs:
        _close_brep_list: List of closed breps to convert to Polyface3D stored in a json file
        (mostly to send them to the urban canopy)
        _prefix: Prefix to add to the identifier of the Polyface3D object. Make sure it is unique to this project
        _file_name_ : Name of the json file to create without extension (Default: polyface3d)
        _path_folder_: True if you want to keep the context of the HB Model of the hbjsons. (Default: False)
        _run: Plug in a button to run the component
    Output:
        path_polyface3d_json_file: path to the json file containing the polyface3d object"""

__author__ = "elie-medioni"
__version__ = "2024.05.05"

ghenv.Component.Name = "BUA Convert Breps To Polyface3D Json"
ghenv.Component.NickName = 'ConvertBrepsToPolyface3DJson'
ghenv.Component.Category = 'BUA'
ghenv.Component.SubCategory = '1 :: Load Buildings'

import os
import json

from ladybug_rhino.togeometry import to_polyface3d


def clean_path(path):
    path = path.replace("\\", "/")
    return (path)


# Get Appdata\local folder
local_appdata = os.environ['LOCALAPPDATA']
path_tool = os.path.join(local_appdata, "Building_urban_analysis")
name_folder_temporary_files = "temporary_files"
default_file_name = "polyface3d"

if _file_name_ is None or _file_name_ == "":
    _file_name_ = default_file_name
if _path_folder_ is None or _path_folder == "":
    _path_folder_ = os.path.join(path_tool, "Simulation_temp", name_folder_temporary_files)
elif os.path.isdir(_path_folder_) is False:
    raise ValueError("The path folder does not exist, enter a valid path")

if _close_brep_list is not None and not _close_brep_list == []:
    for brep in _close_brep_list:
        if not brep.IsSolid:
            raise ValueError("At least one of the Brep is not closed, only close Brep can be loaded")

path_polyface3d_json_file = os.path.join(_path_folder_, _file_name_ + ".json")

if _run:
    # Check the inputs
    if _close_brep_list is None or _close_brep_list == []:
        raise ValueError("The list of breps is empty")
    if _prefix is None or _prefix == "":
        raise ValueError("The prefix is empty")

    

    # Create the temparary simulation folder if it does not exist if needed
    if not os.path.exists(_path_folder_):
        os.makedirs(_path_folder_)

    # Initialize the list of polyface3d
    polyface3d_dict = {}
    # Convert the closed breps to polyface3d
    for index, brep in enumerate(_close_brep_list):
        polyface3d_dict["{}_{}".format(_prefix, index)] = to_polyface3d(brep).to_dict()
    # Create the json file
    with open(path_polyface3d_json_file, 'w') as outfile:
        json.dump(polyface3d_dict, outfile)
# ---------- end convertbrepstopolyface3djson ----------
load_brep_to_urban_canopy = Button()
loadpolyface3djson = BUALoadPolyface3DJson(
    path_simulation_folder=filter,
    path_polyface3d_json_file=convertbrepstopolyface3djson.path_polyface3d_json_file,
    run=load_brep_to_urban_canopy)  # -> out, report, path_simulation_folder; inputs run: Boolean
# ---------- loadpolyface3djson: Python ----------
""" Load Polyface3D json file into the urban canopy object as a buildings
    Inputs:
        path_simulation_folder_: Path to the simulation folder. Default = Appdata\Local\Building_urban_analysis\Simulation_temp
        _path_polyface3d_json_file: Path to the json file containing the polyface3d object
        _typology_: Typology of the buildings, from List Of Typology Component. Cannot be used yet in the code.  Default = None
        _run: Plug in a button to run the component
    Output:
        report: logs
        path_simulation_folder_: Path to the simulation folder."""

__author__ = "elie-medioni"
__version__ = "2024.05.05"

ghenv.Component.Name = "BUA Load Polyface3D json"
ghenv.Component.NickName = 'LoadPolyface3Djson'
ghenv.Component.Category = 'BUA'
ghenv.Component.SubCategory = '1 :: Load Buildings'

import os


def clean_path(path):
    path = path.replace("\\", "/")
    return (path)


def read_logs(path_simulation_folder):
    path_log_file = os.path.join(path_simulation_folder, "gh_components_logs",
                                 ghenv.Component.NickName + ".log")
    if os.path.isfile(path_log_file):
        with open(path_log_file, 'r') as log_file:
            log_data = log_file.read()
        return (log_data)
    else:
        return ("No log file found")


# Get Appdata\local folder
local_appdata = os.environ['LOCALAPPDATA']
path_tool = os.path.join(local_appdata, "Building_urban_analysis")
path_bat_file = os.path.join(path_tool, "Scripts", "mains_tool", "run_BUA.bat")

# Check path_simulation_folder_
if path_simulation_folder_ is None or path_simulation_folder_=="":
    path_simulation_folder_ = os.path.join(path_tool, "Simulation_temp")
elif os.path.isdir(path_simulation_folder_) is False:
    raise ValueError("The simulation folder does not exist, enter a valid path")

# Possible values for typology, for now not operational
typology_possible_values_list = ["VALUES WILL BE PUT WHEN THE FUNCTION WILL BE OPERATIONAL"]

if _path_polyface3d_json_file is not None and not os.path.isfile(clean_path(_path_polyface3d_json_file)):
    raise ValueError("The polyface3d json file does not exist, enter a valid path")

if _run:

    # Write the command
    command = path_bat_file
    # Steps to execute
    argument = " "
    argument = argument + "--make_simulation_folder 1 " + "--create_or_load_urban_canopy_object 1 " + "--save_urban_canopy_object_to_pickle 1 " + "--save_urban_canopy_object_to_json 1 " + "--extract_buildings_from_polyface3d_json 1 "
    # OPtionnal argument of the bat file/Python script
    if path_simulation_folder_ is not None:
        argument = argument + ' -f "{}"'.format(clean_path(path_simulation_folder_))
    if os.path.isfile(clean_path(_path_polyface3d_json_file)):
        argument = argument + ' --path_file "{}"'.format(clean_path(_path_polyface3d_json_file))
    if _typology_ is not None or _typology_ in typology_possible_values_list:
        argument = argument + ' --typology "{}"'.format(_typology_)

    # Add the name of the component to the argument
    argument = argument + " -c {}".format(ghenv.Component.NickName)
    # Run the bat file
    output = os.system(command + argument)

# Read the log file
report = read_logs(path_simulation_folder_)
# ---------- end loadpolyface3djson ----------

# ----
# Load BuildingModeled
falsestart_2 = LBFalseStartToggle(False)
getsampledataforexamplefile_2 = BUAGetSampleDataForExampleFile(run=falsestart_2)  # -> out, path_sample_gis, path_sample_epw_file, path_sample_folder_hbjson, path_sample_hbjson_list, sample_hb_model_list; inputs run: Boolean; same code as getsampledataforexamplefile

# ----
# Load Buildings from hbjson
panel = Panel("0")
load_hbjsons_in_the_urban_canopy = Button()
item = ListItem(List=getsampledataforexamplefile_2.path_sample_hbjson_list, Index=panel, Wrap=True)
loadhbjson = BUALoadHBjsonsInUrbanCanopy(
    path_simulation_folder=filter,
    path_hbjson_file=item,
    are_targets=Toggle(True),
    keep_context=Toggle(False),
    run=load_hbjsons_in_the_urban_canopy)  # -> report, path_simulation_folder; inputs are_targets: Boolean, keep_context: Boolean, run: Boolean
# ---------- loadhbjson: Python ----------
"""Add HB Models from hbjson to the urban canopy building collection
    Inputs:
        path_simulation_folder_: Path to the simulation folder. By default, the code will be run in Appdata\Roaming\Building_urban_analysis\Simulation_temp
        _path_hbjson_file_: Path to a hbjson file containing a HB Model to load in the Urban canopy
        _path_folder_with_hbjson_: Path to a directory containing hbjson files, containing HB Models to load in the Urban canopy
        _are_targets_ : True if the buildings to add are target buildings that we want to simulate
        keep_context_: True if you want to keep the context of the HB Model of the hbjsons. (Default: False)
        _run: Plug in a button to run the component
    Output:
        report: logs
        path_folder_simulation_: path to the simulation folder to pass down to the next components"""

ghenv.Component.Name = "BUA Load HBjsons in Urban Canopy"
ghenv.Component.NickName = 'LoadHBjson'
ghenv.Component.Message = '0.0.0'
ghenv.Component.Category = 'BUA'
ghenv.Component.SubCategory = '1 :: Load Buildings'
ghenv.Component.AdditionalHelpFromDocStrings = "1"

import os
import shutil
from honeybee.model import Model


def clean_path(path):
    path = path.replace("\\", "/")
    return (path)


def read_logs(path_simulation_folder):
    path_log_file = os.path.join(path_simulation_folder_, "gh_components_logs",
                                 ghenv.Component.NickName + ".log")
    if os.path.isfile(path_log_file):
        with open(path_log_file, 'r') as log_file:
            log_data = log_file.read()
        return (log_data)
    else:
        return ("No log file found")



# Get Appdata\local folder
local_appdata = os.environ['LOCALAPPDATA']
path_tool = os.path.join(local_appdata, "Building_urban_analysis")

path_bat_file = os.path.join(path_tool, "Scripts", "mains_tool", "run_BUA.bat")

if _run and ((_path_hbjson_file_ is not None and os.path.isfile(_path_hbjson_file_)) or (
        _path_folder_with_hbjson_ is not None and os.path.isdir(_path_folder_with_hbjson_))):

    # Write the command
    command = path_bat_file
    argument = " "  # Initialize the argument
    # Steps to execute
    argument = argument + "--make_simulation_folder 1 " + "--create_or_load_urban_canopy_object 1 " + "--extract_buildings_from_hbjson_models 1 " + "--save_urban_canopy_object_to_pickle 1 " + " --save_urban_canopy_object_to_json 1"

    # Optional argument of the bat file/Python script
    if path_simulation_folder_ is not None:
        argument = argument + ' -f "{}"'.format(path_simulation_folder_)
    if type(_are_targets_) is bool:
        argument = argument + ' -t "{}"'.format(int(_are_targets_))
    if type(keep_context_) is bool:
        argument = argument + ' --keep_context "{}"'.format(int(keep_context_))
    if _path_hbjson_file_ is not None and os.path.isfile(clean_path(_path_hbjson_file_)):
        argument = argument + ' --path_file "{}"'.format(clean_path(_path_hbjson_file_))
    if _path_folder_with_hbjson_ is not None and os.path.isdir(clean_path(_path_folder_with_hbjson_)):
        argument = argument + ' --path_folder "{}"'.format(clean_path(_path_folder_with_hbjson_))
    # Add the name of the component to the argument
    argument = argument + " -c {}".format(ghenv.Component.NickName)
    # Run the bat file
    output = os.system(command + argument)

# set default value for the simulation folder if not provided
if path_simulation_folder_ is None:
    path_simulation_folder_ = os.path.join(path_tool, "Simulation_temp")
# read the log file
report = read_logs(path_simulation_folder_)
# ---------- end loadhbjson ----------

# ----
# Load Buildings from a folder of hbjsons
load_hbjsons_in_the_urban_canopy_2 = Button()
loadhbjson_2 = BUALoadHBjsonsInUrbanCanopy(
    path_simulation_folder=filter,
    path_folder_with_hbjson=getsampledataforexamplefile_2.path_sample_folder_hbjson,
    are_targets=Toggle(True),
    keep_context=Toggle(False),
    run=load_hbjsons_in_the_urban_canopy_2)  # -> report, path_simulation_folder; inputs are_targets: Boolean, keep_context: Boolean, run: Boolean; same code as loadhbjson

# ----
# Load Buildings from HB Models
load_hbjsons_in_the_urban_canopy_3 = Button()
loadhbm = BUALoadHBModelInUrbanCanopy(
    path_simulation_folder=filter,
    hb_model_list=flatten(getsampledataforexamplefile_2.sample_hb_model_list),
    are_targets=Toggle(True),
    keep_context=Toggle(False),
    run=load_hbjsons_in_the_urban_canopy_3)  # -> report, path_simulation_folder; inputs hb_model_list: list, are_targets: Boolean, keep_context: Boolean, run: Boolean
# ---------- loadhbm: Python ----------
"""Add a list of HB Models of buildings to the urban canopy building collecting.
    Inputs:
        path_simulation_folder: Path to the simulation folder. By default, the code will be run in Appdata\Roaming\Building_urban_analysis\Simulation_temp
        _hb_model_list: List of Honeybee Models of buildings
        _are_targets_ : True if the buildings to add are target buildings that we want to simulate
        keep_context_: True if you want to keep the context of the HB Model of the hbjsons. (Default: False)
        _run: Plug in a button to run the component
    Output:
        report: logs
        path_folder_simulation_: path to the simulation folder to pass down to the next components"""

ghenv.Component.Name = "BUA Load HB Model in Urban Canopy"
ghenv.Component.NickName = 'LoadHBM'
ghenv.Component.Message = '0.0.0'
ghenv.Component.Category = 'BUA'
ghenv.Component.SubCategory = '1 :: Load Buildings'
ghenv.Component.AdditionalHelpFromDocStrings = "1"

import os
import shutil
from honeybee.model import Model


def clean_path(path):
    path = path.replace("\\", "/")
    return (path)


def read_logs(path_simulation_folder):
    path_log_file = os.path.join(path_simulation_folder_, "gh_components_logs",
                                 ghenv.Component.NickName + ".log")
    if os.path.isfile(path_log_file):
        with open(path_log_file, 'r') as log_file:
            log_data = log_file.read()
        return (log_data)
    else:
        return ("No log file found")


# Get Appdata\local folder
local_appdata = os.environ['LOCALAPPDATA']
path_tool = os.path.join(local_appdata, "Building_urban_analysis")
path_bat_file = os.path.join(path_tool, "Scripts", "mains_tool", "run_BUA.bat")
name_folder_temporary_files = "temporary_files"
name_hbjson_directory = "hbjsons_to_add"  # name of the folder that will contain the hbjsons to add

# set default value for the simulation folder if not provided
if path_simulation_folder_ is None:
    path_simulation_folder_ = os.path.join(path_tool, "Simulation_temp")
else:
    path_simulation_folder_ = clean_path(path_simulation_folder_)

if _run and _hb_model_list is not None and _hb_model_list != []:
    # Make new folder in the simulation folder to store the honeybee models converted to json
    path_folder_honeybee_json = os.path.join(path_simulation_folder_, name_folder_temporary_files,
                                             name_hbjson_directory)
    if not os.path.exists(path_folder_honeybee_json):
        os.makedirs(path_folder_honeybee_json)
    else:
        shutil.rmtree(path_folder_honeybee_json)  # Delete the existing folder
        os.makedirs(path_folder_honeybee_json)  # Create a new folder in its place

    # Convert the honeybee models to json
    for i, hb_model in enumerate(_hb_model_list):
        # Make a name for the json file
        name_hb_model = "model_{}".format(i)
        # Make the path to the json file
        path_hb_model = os.path.join(path_folder_honeybee_json, name_hb_model + ".hbjson")
        # Convert the honeybee model to json
        Model.to_hbjson(hb_model, path_hb_model)

    # Write the command
    command = path_bat_file
    argument = " "  # Initialize the argument
    # Steps to execute
    argument = argument + "--make_simulation_folder 1 " + "--create_or_load_urban_canopy_object 1 " + "--path_folder {} ".format(
        path_folder_honeybee_json) + "--extract_buildings_from_hbjson_models 1 " + "--save_urban_canopy_object_to_pickle 1 " + " --save_urban_canopy_object_to_json 1"

    # Optional argument of the bat file/Python script
    if path_simulation_folder_ is not None:
        argument = argument + ' -f "{}"'.format(path_simulation_folder_)
    if _are_targets_ is not None:
        argument = argument + ' -t "{}"'.format(int(_are_targets_))
    if type(keep_context_) is bool:
        argument = argument + ' --keep_context "{}"'.format(int(keep_context_))
    # Add the name of the component to the argument
    argument = argument + " -c {}".format(ghenv.Component.NickName)
    # Run the bat file
    output = os.system(command + argument)
    # Delete the folder with the honeybee models converted to json
    shutil.rmtree(path_folder_honeybee_json)

# Read the log file
report = read_logs(path_simulation_folder_)
# ---------- end loadhbm ----------

# ----
# Plot HB Models of BuildingModeled from Urban Canopy
falsestart_3 = LBFalseStartToggle(False)
gethbmodels = BUAGetHBModels(path_simulation_folder=filter, run=falsestart_3)  # -> hb_model_list; inputs building_id_list: list
# ---------- gethbmodels: Python ----------
"""Get the HB models from the urban canopy json file
    Inputs:
        path_simulation_folder_: Path to the simulation folder
        _building_id_list_ : List of the building id to get teh HB models. If empty, get all the HB models.
        _run : Plug a boolean toggle. Put it to true if we want to run the code.
    Output:
        hb_model_list: List of the HB models"""

__author__ = "elie-medioni"
__version__ = "2024.05.05"

ghenv.Component.Name = "BUA Get HB Models"
ghenv.Component.NickName = 'GetHBModels'
ghenv.Component.Category = 'BUA'
ghenv.Component.SubCategory = '2 :: Information'
ghenv.Component.AdditionalHelpFromDocStrings = "1"


import json
import os

from honeybee.model import Model

# Get Appdata\local folder
local_appdata = os.environ['LOCALAPPDATA']
path_tool = os.path.join(local_appdata, "Building_urban_analysis")

# set default value for the simulation folder if not provided
if path_simulation_folder_ is None:
    path_simulation_folder_ = os.path.join(path_tool, "Simulation_temp")

path_json = os.path.join(path_simulation_folder_, "urban_canopy.json")

if _run and os.path.isfile(path_json):

    path_json = os.path.join(path_simulation_folder_, "urban_canopy.json")
    with open(path_json, "r") as f:
        urban_canopy_dict = json.load(f)
    # Get the list of the building ids to display
    if _building_id_list_ == [] or _building_id_list_ is None:
        _building_id_list_ = []
        # add the id of the target building
        for building_id in list(urban_canopy_dict["buildings"].keys()):
            if urban_canopy_dict["buildings"][building_id]["type"] == "BuildingModeled":
                _building_id_list_.append(building_id)
    else:  # Check if the building ids are in the json file
        for building_id in _building_id_list_:
            try:
                urban_canopy_dict["buildings"][building_id]
            except KeyError:
                raise KeyError("Building with ID '{}' not found in the dictionary.".format(building_id))
            else:
                if not urban_canopy_dict["buildings"][building_id]["type"] == "BuildingModeled":
                    raise ValueError(
                        "Building with ID {} does not have a HB model and thus not shades".format(
                            building_id))

    hb_model_list = []
    for building_id in _building_id_list_:
        if urban_canopy_dict["buildings"][building_id]["hb_model"] is not None:
            hb_model_list.append(Model.from_dict(urban_canopy_dict["buildings"][building_id]["hb_model"]))

if not os.path.isfile(path_json):
    print("the json file of the urban canopy does not exist")
# ---------- end gethbmodels ----------
vizall = HBVisualizeAll(hb_objs=flatten(gethbmodels))  # -> geo; plug-in component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
