# Grasshopper definition BUA_example_3_BIPV_and_KPI_simulation.gh (Grasshopper 1.0.7)
# plug-ins: LadybugGrasshopper

# ----
# Load Sample files
falsestart = LBFalseStartToggle(True)
getsampledataforexamplefile = BUAGetSampleDataForExampleFile(run=falsestart)  # -> out, path_sample_gis, path_sample_epw_file, path_sample_folder_hbjson, path_sample_hbjson_list, sample_hb_model_list; inputs run: Boolean
# ---------- getsampledataforexamplefile: Python ----------
"""Get the path to sample data from the library folder
    Inputs:
        _run : Plug in a boolean toggle to run the component and load the samples
    Output:
        path_sample_gis : list of the gis file in the library folder
        path_sample_epw_file : list of the path to the epw files
        path_sample_folder_hbjson : path to the folder containing the hbjon files
        path_sample_hbjson_list : list of the path to the honeybee json files
        sample_hb_model_list : list of the path to the honeybee models"""

__author__ = "elie-medioni"
__version__ = "2024.05.27"

from ghpythonlib.componentbase import executingcomponent as component


ghenv.Component.Name = "BUA Get Sample Data For Example File"
ghenv.Component.NickName = 'GetSampleDataForExampleFile'
ghenv.Component.Message = '1.1.0'
ghenv.Component.Category = 'BUA'
ghenv.Component.SubCategory = '7 :: General'

import os

from honeybee.model import Model

if _run:
    # Get Appdata\local folder
    local_appdata = os.environ['LOCALAPPDATA']
    path_tool = os.path.join(local_appdata, "Building_urban_analysis")
    path_data_libraries_samples = os.path.join(path_tool, "Libraries","Samples_for_example_file")

    # Get the list of the gis files
    path_gis_folder = os.path.join(path_data_libraries_samples, "gis")
    path_sample_gis = [os.path.join(path_gis_folder, gis_file_name) for gis_file_name in os.listdir(path_gis_folder)][0]

    # Get the epw files
    path_epw_folder = os.path.join(path_data_libraries_samples, "epw")
    path_sample_epw_file = [os.path.join(path_epw_folder, epw_file_name) for epw_file_name in os.listdir(path_epw_folder)][0]

    # Get the hbjson files
    path_sample_folder_hbjson = os.path.join(path_data_libraries_samples, "hbjson_models")
    path_sample_hbjson_list = [os.path.join(path_sample_folder_hbjson, hbjson_file_name) for hbjson_file_name in
                        os.listdir(path_sample_folder_hbjson)]

    # Get the hb models
    sample_hb_model_list = [Model.from_hbjson(path_hbjson) for path_hbjson in path_sample_hbjson_list]
# ---------- end getsampledataforexamplefile ----------

# ----
# Load BuildingBasics from GIS
path_to_user_simulation_folder = Panel()
list = ValueList({"user simulation folder": 0, "default simulation folder": 1}, selected="default simulation folder")
addgisattributekeys = BUAAddGISAttributeKeys()  # -> report, gis_attribute_key_dict; inputs name: list, age: list, typology: list, elevation: list, height: list, number_of_floor: list, group: list
# ---------- addgisattributekeys: Python ----------
"""Add  additional keys to load GIS attributes. GIS files can use different keys to store the same information (height, elevation...). This component allows you to add additional keys to the GIS attributes. Not all attributes need to be added as default value will be used if they cannot be extracted from the GIS, but certain attributes, such as the elevation, the height or the number can have a significant impact on the simulation results and it is recommended to add teh proper keys to extract them. It is mandatory to provide the key to identify the building ID in the GIS file. If this attribute does not exist add one manually in the GIS file with the QGIS software for instance. Only use GIS that use attributes keys and values with latin alphabet characters. Using other alphabets can lead to errors.
     Inputs:
        _building_id_key_gis: Key to identify the building ID in the GIS file.
        name_: List of keys to identify the name of the building in the GIS file. Keys already included: ["name", "full_name_"]
        age_: List of keys to identify the age of the building in the GIS file. Keys already included: ["age", "date", "year"]
        typology_: List of keys to identify the typology of the building in the GIS file. Keys already included: ["typo","typology","type","Typology"]
        elevation_: List of keys to identify the elevation of the building in the GIS file. Keys already included: ["minheight"]
        height_: List of keys to identify the height of the building in the GIS file. Keys already included: ["height", "Height","govasimple"]
        number_of_floor_: List of keys to identify the number of floors of the building in the GIS file. Keys already included: ["number_floor", "nb_floor", "mskomot"]
        group_: List of keys to identify the group of the building in the GIS file. Keys already included: ["group"]
    Output:
        gis_attribute_key_dict: Dictionary containing the additional keys to load GIS attributes.
"""

__author__ = "elie-medioni"
__version__ = "2024.03.31"

ghenv.Component.Name = "BUA Add GIS Attribute Keys"
ghenv.Component.NickName = 'AddGISAttributeKeys'
ghenv.Component.Category = 'BUA'
ghenv.Component.SubCategory = '1 :: Load Buildings'
ghenv.Component.AdditionalHelpFromDocStrings = "1"

import json

# Initialize the replacement scenario parameter dictionary
gis_attribute_key_dict = {
    "building_id_key_gis": None,
    "name": [],
    "age": [],
    "typology": [],
    "elevation": [],
    "height": [],
    "number of floor": [],
    "group": []
}

# Check the _building_id_key_gis
if _building_id_key_gis is not None:
    gis_attribute_key_dict["building_id_key_gis"] = _building_id_key_gis
# Check the name_
if name_ is not None:
    gis_attribute_key_dict["name"] = name_
# Check the age_
if age_ is not None:
    gis_attribute_key_dict["age"] = age_
# Check the typology_
if typology_ is not None:
    gis_attribute_key_dict["typology"] = typology_
# Check the elevation_
if elevation_ is not None:
    gis_attribute_key_dict["elevation"] = elevation_
# Check the height_
if height_ is not None:
    gis_attribute_key_dict["height"] = height_
# Check the number_of_floor_
if number_of_floor_ is not None:
    gis_attribute_key_dict["number of floor"] = number_of_floor_
# Check the group_
if group_ is not None:
    gis_attribute_key_dict["group"] = group_

gis_attribute_key_dict = json.dumps(gis_attribute_key_dict)
# ---------- end addgisattributekeys ----------
filter = StreamFilter(Gate=list, Stream0=path_to_user_simulation_folder)
load_gis_in_urban_canopy = Button()
list_2 = ValueList({"GIS in meter": "m", "GIS in degree": "deg"}, selected="GIS in degree")
loadgisinurbancanopy = BUALoadGISInUrbanCanopy(
    path_simulation_folder=filter,
    path_gis=getsampledataforexamplefile.path_sample_gis,
    unit_gis=list_2,
    gis_attribute_keys_dict=addgisattributekeys.gis_attribute_key_dict,
    move_to_origin=Toggle(True),
    run=load_gis_in_urban_canopy)  # -> report, path_simulation_folder; inputs run: Boolean
# ---------- loadgisinurbancanopy: Python ----------
"""Load buildings from GIS in the Urban Canopy
    Inputs:
        path_simulation_folder_: Path to the folder the simulation will run. By default, the code will run in
                                Appdata\Local\Building_urban_analysis\Simulation_temp
        _path_gis : Path to the folder containing the GIS files (shp...) to load
        _unit_gis_ : Unit of the GIS file, meter ("m")  or degree ("deg"). By default set to meter
        _gis_attribute_keys_dict_ : Connect the component Add GIS Attribute Keys, to add labels for heights,
            number of floors etc. that are not considered by default by the code and that are specific to the
            GIS file you are using.
        move_to_origin_ : Center the urban canopy and its buildings on the origin of the coordinate system
        _run : Add and press a button to run the code
    Output:
        report: Logs
        path_simulation_folder_: Path to the simulation folder to pass down to the next components"""

ghenv.Component.Name = "BUA Load GIS in Urban Canopy"
ghenv.Component.NickName = 'LoadGISInUrbanCanopy'
ghenv.Component.Category = 'BUA'
ghenv.Component.SubCategory = '1 :: Load Buildings'
ghenv.Component.AdditionalHelpFromDocStrings = "1"

import os
import json
import shutil


def clean_path(path):
    path = path.replace("\\", "/")
    return (path)


def read_logs(path_simulation_folder):

    path_log_file = os.path.join(path_simulation_folder_, "gh_components_logs",
                                 ghenv.Component.NickName + ".log")
    if os.path.isfile(path_log_file):
        with open(path_log_file, 'r') as log_file:
            log_data = log_file.read()
        return (log_data)
    else:
        return ("No log file found")

# Get Appdata\local folder
local_appdata = os.environ['LOCALAPPDATA']
path_tool = os.path.join(local_appdata, "Building_urban_analysis")
path_bat_file = os.path.join(path_tool, "Scripts", "mains_tool", "run_BUA.bat")
name_folder_temporary_files = "temporary_files"

# set default value for the simulation folder if not provided

if path_simulation_folder_ is None:
    path_simulation_folder_ = os.path.join(path_tool, "Simulation_temp")
else:
     clean_path(path_simulation_folder_)

# Check GIS attribute keys dictionary
if _gis_attribute_keys_dict_ is not None:
    try:  # try to load the json
        gis_attribute_keys_dict = json.loads(_gis_attribute_keys_dict_)
    except:
        raise ValueError("The GIS attribute keys dictionary is not a valid JSON dictionnary, please use the output of the Add GIS Attribute Keys component")
    mandatory_keys = ["building_id_key_gis", "name", "age", "typology", "elevation", "height", "number of floor", "group"]
    for key in mandatory_keys:
        if key not in gis_attribute_keys_dict:
            raise ValueError("The GIS attribute keys dictionary is missing the key '{}'".format(key))
else:
    gis_attribute_keys_dict = None


if _run:
    # if there are additionnal keys for GIS attributes, make a json file containing the values
    if gis_attribute_keys_dict is not None:
        # Make the simulation folder as it might not exist yet
        command = path_bat_file + " --make_simulation_folder 1 --create_or_load_urban_canopy_object 1 -f " + path_simulation_folder_
        output = os.system(command)
        # Make the json file in the temporary folder in the simulation folder
        path_gis_attribute_keys_dict = os.path.join(path_simulation_folder_, name_folder_temporary_files, "gis_attribute_keys_dict.json")
        with open(path_gis_attribute_keys_dict, 'w') as json_file:
            json.dump(gis_attribute_keys_dict, json_file)
    else:
        path_gis_attribute_keys_dict = None  # Default value
    # Write the command
    command = path_bat_file
    argument = " "  # Initialize the argument
    # Steps to execute
    argument = argument + "--make_simulation_folder 1 " + "--create_or_load_urban_canopy_object 1 " + "--extract_gis 1 " + "--save_urban_canopy_object_to_pickle 1 " + " --save_urban_canopy_object_to_json 1 "
    # OPtionnal argument of the bat file/Python script
    if _path_gis is not None:
        argument = argument + ' -g "{}"'.format(_path_gis)
    if path_simulation_folder_ is not None:
        argument = argument + ' -f "{}"'.format(path_simulation_folder_)
    if path_gis_attribute_keys_dict is not None:
        argument = argument + ' -d "{}"'.format(path_gis_attribute_keys_dict)
    if _unit_gis_ is not None:
        argument = argument + ' -u "{}"'.format(_unit_gis_)
    if move_to_origin_ is not None:
        argument = argument + ' --move_buildings_to_origin "{}"'.format(int(move_to_origin_))
    # Add the name of the component to the argument
    argument = argument + " -c {}".format(ghenv.Component.NickName)
    # Run the bat file
    output = os.system(command + argument)

    # delete json file with the additionnal GIS attributes
    if path_gis_attribute_keys_dict is not None and os.path.exists(path_gis_attribute_keys_dict):
        os.remove(path_gis_attribute_keys_dict)

report = read_logs(path_simulation_folder_)
# ---------- end loadgisinurbancanopy ----------

# ----
# Empty Default Simulation Folder
button = Button()
cleandefaultsimulationfolder = BUACleanDefaultSimulationFolder(run=button)
# ---------- cleandefaultsimulationfolder: Python ----------
"""Clean the default simulation folder.
    Inputs:
        _run: Set to True to run the component"""

__author__ = "Eliewiii"
__version__ = "2024.05.15"

ghenv.Component.Name = "BUA Clean Default Simulation Folder"
ghenv.Component.NickName = 'CleanDefaultSimulationFolder'
ghenv.Component.Message = '1.0.0'
ghenv.Component.Category = 'BUA'
ghenv.Component.SubCategory = '7 :: General'


import shutil
import os

local_appdata = os.environ['LOCALAPPDATA']
path_tool = os.path.join(local_appdata, "Building_urban_analysis")
path_simulation_temp_folder = os.path.join(path_tool, "Simulation_temp")

if _run:
    if os.path.isdir(path_simulation_temp_folder):
        shutil.rmtree(path_simulation_temp_folder)
    os.makedirs(path_simulation_temp_folder)
# ---------- end cleandefaultsimulationfolder ----------

# ----
# Plot Building Envelopes
plot_gis_building_envelop = LBFalseStartToggle(True)
loadbuildingenvelopes = BUALoadBuildingEnvelopes(path_simulation_folder=loadgisinurbancanopy.path_simulation_folder, run=plot_gis_building_envelop)  # -> building_hb_rooms, target_building_modeled_envelopes, non_target_building_modeled_envelopes, building_basic_envelopes; inputs building_id_list: list, run: Boolean
# ---------- loadbuildingenvelopes: Python ----------
"""Plot the buildings inside the Urban Canopy.
    Inputs:
        path_simulation_folder_: Path to the folder. By default, the code will be run in
                                Appdata\Local\Building_urban_analysis\Simulation_temp
        building_id_list_: List of building ids to display. If empty, all the buildings will be displayed.
        _run : True if we want to run the code
    Output:
        target_building_modeled_envelopes : Brep of the envelopes of the target BuildingModeled
        non_target_building_modeled_envelopes : Brep of the envelopes of the non-target BuildingModeled
        building_basic_envelopes : Brep of the envelopes of the BuildingBasic
        building_hb_rooms : list of the HB rooms of representing the envelopes of buildings, can be used
            to display the ids of the buildings
"""

__author__ = "Elie"
__version__ = "2024.05.26"

from ghpythonlib.componentbase import executingcomponent as component

ghenv.Component.Name = "BUA Load Building Envelopes"
ghenv.Component.NickName = 'LoadBuildingEnvelopes'
ghenv.Component.Message = '1.1.0'
ghenv.Component.Category = 'BUA'
ghenv.Component.SubCategory = '2 :: Information'

import json
import os

from honeybee.room import Room

from ladybug_rhino.fromgeometry import from_polyface3d


def clean_path(path):
    path = path.replace("\\", "/")
    return (path)


# Get Appdata\local folder
local_appdata = os.environ['LOCALAPPDATA']
path_tool = os.path.join(local_appdata, "Building_urban_analysis")

# set default value for the simulation folder if not provided
if path_simulation_folder_ is None:
    path_simulation_folder_ = os.path.join(path_tool, "Simulation_temp")

path_json = os.path.join(path_simulation_folder_, "urban_canopy.json")

if _run and os.path.isfile(path_json):

    with open(path_json, "r") as f:
        urban_canopy_dict = json.load(f)

    # Get the list of the building ids to display
    if building_id_list_ == [] or building_id_list_ is None:
        building_id_list_ = list(urban_canopy_dict["buildings"].keys())
    else:  # Check if the building ids are in the json file
        for building_id in building_id_list_:
            try:
                urban_canopy_dict["buildings"][building_id]
            except KeyError:
                raise KeyError("Building with ID '{}' not found in the dictionary.".format(building_id))

    # Initialize the lists
    target_building_modeled_id_list = []
    non_target_building_modeled_id_list = []
    building_basic_id_list = []

    # Get the list of the target, simulated and context buildings
    for building_id in building_id_list_:
        if urban_canopy_dict["buildings"][building_id]["type"] == "BuildingModeled":
            if urban_canopy_dict["buildings"][building_id]["is_target_building"] == True:
                target_building_modeled_id_list.append(building_id)
            else :
                non_target_building_modeled_id_list.append(building_id)
        else:
            building_basic_id_list.append(building_id)

    target_building_modeled_envelopes = []
    non_target_building_modeled_envelopes = []
    building_basic_envelopes = []

    building_hb_rooms = [Room.from_dict(urban_canopy_dict["buildings"][building_id]["hb_room_envelope"]) for
                         building_id in building_id_list_]

    for building_id in target_building_modeled_id_list:
        building_hb_room_envelopes = Room.from_dict(
            urban_canopy_dict["buildings"][building_id]["hb_room_envelope"])
        target_building_modeled_envelopes.append(from_polyface3d(building_hb_room_envelopes.geometry))
    for building_id in non_target_building_modeled_id_list:
        building_hb_room_envelopes = Room.from_dict(
            urban_canopy_dict["buildings"][building_id]["hb_room_envelope"])
        non_target_building_modeled_envelopes.append(from_polyface3d(building_hb_room_envelopes.geometry))
    for building_id in building_basic_id_list:
        building_hb_room_envelopes = Room.from_dict(
            urban_canopy_dict["buildings"][building_id]["hb_room_envelope"])
        building_basic_envelopes.append(from_polyface3d(building_hb_room_envelopes.geometry))

if not os.path.isfile(path_json):
    print("the json file of the urban canopy does not exist")
# ---------- end loadbuildingenvelopes ----------
roomattr = HBRoomAttributes({"Display Name": "display_name", "Simulation Name (Identifier)": "identifier", "Multiplier": "multiplier", "Floor Area Excluded": "exclude_floor_area", "Story": "story", "Volume": "volume", "Gross Floor Area": "floor_area", "Exposed Area": "exposed_area", "Exterior Wall Area": "exterior_wall_area", "Exterior Aperture Area": "exterior_aperture_area", "Average Floor Elevation": "average_floor_height"}, selected="Display Name")
brep = Brep(loadbuildingenvelopes.non_target_building_modeled_envelopes)
brep_2 = Brep(loadbuildingenvelopes.building_basic_envelopes)
brep_3 = Brep(loadbuildingenvelopes.target_building_modeled_envelopes)

labelrooms = HBLabelRooms(rooms_model=flatten(loadbuildingenvelopes.building_hb_rooms), attribute=roomattr)  # -> label_text, base_pts, labels, wire_frame; plug-in component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
preview = CustomPreview(Geometry=brep_3, Material=ColourSwatch(SwatchColor=RGBA(73, 214, 162, 133)))
preview_2 = CustomPreview(Geometry=brep, Material=ColourSwatch(SwatchColor=RGBA(227, 127, 127, 133)))
preview_3 = CustomPreview(Geometry=brep_2, Material=ColourSwatch(SwatchColor=RGBA(181, 181, 181, 133)))

# ----
# Load BuildingBasic from Closed Breps
save_brep_to_json = LBFalseStartToggle(False)
your_brep_geometry = Brep()
convertbrepstopolyface3djson = BUAConvertBrepsToPolyface3DJson(close_brep_list=flatten(your_brep_geometry), prefix="from_brep", file_name="geometry_from_brep", run=save_brep_to_json)  # -> out, path_polyface3d_json_file; inputs close_brep_list: list of Brep, run: Boolean
# ---------- convertbrepstopolyface3djson: Python ----------
"""Convert a list of closed breps to Laadybug geometry Polyface3D object stored in a json file (mostly to send them to the urban canopy)
    Inputs:
        _close_brep_list: List of closed breps to convert to Polyface3D stored in a json file
        (mostly to send them to the urban canopy)
        _prefix: Prefix to add to the identifier of the Polyface3D object. Make sure it is unique to this project
        _file_name_ : Name of the json file to create without extension (Default: polyface3d)
        _path_folder_: True if you want to keep the context of the HB Model of the hbjsons. (Default: False)
        _run: Plug in a button to run the component
    Output:
        path_polyface3d_json_file: path to the json file containing the polyface3d object"""

__author__ = "elie-medioni"
__version__ = "2024.05.05"

ghenv.Component.Name = "BUA Convert Breps To Polyface3D Json"
ghenv.Component.NickName = 'ConvertBrepsToPolyface3DJson'
ghenv.Component.Category = 'BUA'
ghenv.Component.SubCategory = '1 :: Load Buildings'

import os
import json

from ladybug_rhino.togeometry import to_polyface3d


def clean_path(path):
    path = path.replace("\\", "/")
    return (path)


# Get Appdata\local folder
local_appdata = os.environ['LOCALAPPDATA']
path_tool = os.path.join(local_appdata, "Building_urban_analysis")
name_folder_temporary_files = "temporary_files"
default_file_name = "polyface3d"

if _file_name_ is None or _file_name_ == "":
    _file_name_ = default_file_name
if _path_folder_ is None or _path_folder == "":
    _path_folder_ = os.path.join(path_tool, "Simulation_temp", name_folder_temporary_files)
elif os.path.isdir(_path_folder_) is False:
    raise ValueError("The path folder does not exist, enter a valid path")

if _close_brep_list is not None and not _close_brep_list == []:
    for brep in _close_brep_list:
        if not brep.IsSolid:
            raise ValueError("At least one of the Brep is not closed, only close Brep can be loaded")

path_polyface3d_json_file = os.path.join(_path_folder_, _file_name_ + ".json")

if _run:
    # Check the inputs
    if _close_brep_list is None or _close_brep_list == []:
        raise ValueError("The list of breps is empty")
    if _prefix is None or _prefix == "":
        raise ValueError("The prefix is empty")

    

    # Create the temparary simulation folder if it does not exist if needed
    if not os.path.exists(_path_folder_):
        os.makedirs(_path_folder_)

    # Initialize the list of polyface3d
    polyface3d_dict = {}
    # Convert the closed breps to polyface3d
    for index, brep in enumerate(_close_brep_list):
        polyface3d_dict["{}_{}".format(_prefix, index)] = to_polyface3d(brep).to_dict()
    # Create the json file
    with open(path_polyface3d_json_file, 'w') as outfile:
        json.dump(polyface3d_dict, outfile)
# ---------- end convertbrepstopolyface3djson ----------
load_brep_to_urban_canopy = Button()
loadpolyface3djson = BUALoadPolyface3DJson(
    path_simulation_folder=filter,
    path_polyface3d_json_file=convertbrepstopolyface3djson.path_polyface3d_json_file,
    run=load_brep_to_urban_canopy)  # -> out, report, path_simulation_folder; inputs run: Boolean
# ---------- loadpolyface3djson: Python ----------
""" Load Polyface3D json file into the urban canopy object as a buildings
    Inputs:
        path_simulation_folder_: Path to the simulation folder. Default = Appdata\Local\Building_urban_analysis\Simulation_temp
        _path_polyface3d_json_file: Path to the json file containing the polyface3d object
        _typology_: Typology of the buildings, from List Of Typology Component. Cannot be used yet in the code.  Default = None
        _run: Plug in a button to run the component
    Output:
        report: logs
        path_simulation_folder_: Path to the simulation folder."""

__author__ = "elie-medioni"
__version__ = "2024.05.05"

ghenv.Component.Name = "BUA Load Polyface3D json"
ghenv.Component.NickName = 'LoadPolyface3Djson'
ghenv.Component.Category = 'BUA'
ghenv.Component.SubCategory = '1 :: Load Buildings'

import os


def clean_path(path):
    path = path.replace("\\", "/")
    return (path)


def read_logs(path_simulation_folder):
    path_log_file = os.path.join(path_simulation_folder, "gh_components_logs",
                                 ghenv.Component.NickName + ".log")
    if os.path.isfile(path_log_file):
        with open(path_log_file, 'r') as log_file:
            log_data = log_file.read()
        return (log_data)
    else:
        return ("No log file found")


# Get Appdata\local folder
local_appdata = os.environ['LOCALAPPDATA']
path_tool = os.path.join(local_appdata, "Building_urban_analysis")
path_bat_file = os.path.join(path_tool, "Scripts", "mains_tool", "run_BUA.bat")

# Check path_simulation_folder_
if path_simulation_folder_ is None or path_simulation_folder_=="":
    path_simulation_folder_ = os.path.join(path_tool, "Simulation_temp")
elif os.path.isdir(path_simulation_folder_) is False:
    raise ValueError("The simulation folder does not exist, enter a valid path")

# Possible values for typology, for now not operational
typology_possible_values_list = ["VALUES WILL BE PUT WHEN THE FUNCTION WILL BE OPERATIONAL"]

if _path_polyface3d_json_file is not None and not os.path.isfile(clean_path(_path_polyface3d_json_file)):
    raise ValueError("The polyface3d json file does not exist, enter a valid path")

if _run:

    # Write the command
    command = path_bat_file
    # Steps to execute
    argument = " "
    argument = argument + "--make_simulation_folder 1 " + "--create_or_load_urban_canopy_object 1 " + "--save_urban_canopy_object_to_pickle 1 " + "--save_urban_canopy_object_to_json 1 " + "--extract_buildings_from_polyface3d_json 1 "
    # OPtionnal argument of the bat file/Python script
    if path_simulation_folder_ is not None:
        argument = argument + ' -f "{}"'.format(clean_path(path_simulation_folder_))
    if os.path.isfile(clean_path(_path_polyface3d_json_file)):
        argument = argument + ' --path_file "{}"'.format(clean_path(_path_polyface3d_json_file))
    if _typology_ is not None or _typology_ in typology_possible_values_list:
        argument = argument + ' --typology "{}"'.format(_typology_)

    # Add the name of the component to the argument
    argument = argument + " -c {}".format(ghenv.Component.NickName)
    # Run the bat file
    output = os.system(command + argument)

# Read the log file
report = read_logs(path_simulation_folder_)
# ---------- end loadpolyface3djson ----------

# ----
# Load BuildingModeled
# Note: Load only 3 buildings out of 11 as targets
falsestart_2 = LBFalseStartToggle(True)
getsampledataforexamplefile_2 = BUAGetSampleDataForExampleFile(run=falsestart_2)  # -> out, path_sample_gis, path_sample_epw_file, path_sample_folder_hbjson, path_sample_hbjson_list, sample_hb_model_list; inputs run: Boolean; same code as getsampledataforexamplefile
index_of_target_buildings = Panel("""0
3
7""")

panel = Panel(getsampledataforexamplefile_2.sample_hb_model_list)
index_of_target_buildings_2 = Panel("""1
2
4
5
6
8
9
10""")
item = ListItem(List=getsampledataforexamplefile_2.sample_hb_model_list, Index=index_of_target_buildings, Wrap=True)  # -> flatten(Item)
item_2 = ListItem(List=getsampledataforexamplefile_2.sample_hb_model_list, Index=index_of_target_buildings_2, Wrap=True)  # -> flatten(Item)
panel_2 = Panel(item)
panel_3 = Panel(item_2)

# ----
# Load non-target Buildings from HB Models
load_non_target_buildings_from_hb_models = Button()
loadhbm = BUALoadHBModelInUrbanCanopy(
    path_simulation_folder=filter,
    hb_model_list=flatten(item_2),
    are_targets=Toggle(False),
    keep_context=Toggle(False),
    run=load_non_target_buildings_from_hb_models)  # -> report, path_simulation_folder; inputs hb_model_list: list, are_targets: Boolean, keep_context: Boolean, run: Boolean
# ---------- loadhbm: Python ----------
"""Add a list of HB Models of buildings to the urban canopy building collecting.
    Inputs:
        path_simulation_folder: Path to the simulation folder. By default, the code will be run in Appdata\Roaming\Building_urban_analysis\Simulation_temp
        _hb_model_list: List of Honeybee Models of buildings
        _are_targets_ : True if the buildings to add are target buildings that we want to simulate
        keep_context_: True if you want to keep the context of the HB Model of the hbjsons. (Default: False)
        _run: Plug in a button to run the component
    Output:
        report: logs
        path_folder_simulation_: path to the simulation folder to pass down to the next components"""

ghenv.Component.Name = "BUA Load HB Model in Urban Canopy"
ghenv.Component.NickName = 'LoadHBM'
ghenv.Component.Message = '0.0.0'
ghenv.Component.Category = 'BUA'
ghenv.Component.SubCategory = '1 :: Load Buildings'
ghenv.Component.AdditionalHelpFromDocStrings = "1"

import os
import shutil
from honeybee.model import Model


def clean_path(path):
    path = path.replace("\\", "/")
    return (path)


def read_logs(path_simulation_folder):
    path_log_file = os.path.join(path_simulation_folder_, "gh_components_logs",
                                 ghenv.Component.NickName + ".log")
    if os.path.isfile(path_log_file):
        with open(path_log_file, 'r') as log_file:
            log_data = log_file.read()
        return (log_data)
    else:
        return ("No log file found")


# Get Appdata\local folder
local_appdata = os.environ['LOCALAPPDATA']
path_tool = os.path.join(local_appdata, "Building_urban_analysis")
path_bat_file = os.path.join(path_tool, "Scripts", "mains_tool", "run_BUA.bat")
name_folder_temporary_files = "temporary_files"
name_hbjson_directory = "hbjsons_to_add"  # name of the folder that will contain the hbjsons to add

# set default value for the simulation folder if not provided
if path_simulation_folder_ is None:
    path_simulation_folder_ = os.path.join(path_tool, "Simulation_temp")
else:
    path_simulation_folder_ = clean_path(path_simulation_folder_)

if _run and _hb_model_list is not None and _hb_model_list != []:
    # Make new folder in the simulation folder to store the honeybee models converted to json
    path_folder_honeybee_json = os.path.join(path_simulation_folder_, name_folder_temporary_files,
                                             name_hbjson_directory)
    if not os.path.exists(path_folder_honeybee_json):
        os.makedirs(path_folder_honeybee_json)
    else:
        shutil.rmtree(path_folder_honeybee_json)  # Delete the existing folder
        os.makedirs(path_folder_honeybee_json)  # Create a new folder in its place

    # Convert the honeybee models to json
    for i, hb_model in enumerate(_hb_model_list):
        # Make a name for the json file
        name_hb_model = "model_{}".format(i)
        # Make the path to the json file
        path_hb_model = os.path.join(path_folder_honeybee_json, name_hb_model + ".hbjson")
        # Convert the honeybee model to json
        Model.to_hbjson(hb_model, path_hb_model)

    # Write the command
    command = path_bat_file
    argument = " "  # Initialize the argument
    # Steps to execute
    argument = argument + "--make_simulation_folder 1 " + "--create_or_load_urban_canopy_object 1 " + "--path_folder {} ".format(
        path_folder_honeybee_json) + "--extract_buildings_from_hbjson_models 1 " + "--save_urban_canopy_object_to_pickle 1 " + " --save_urban_canopy_object_to_json 1"

    # Optional argument of the bat file/Python script
    if path_simulation_folder_ is not None:
        argument = argument + ' -f "{}"'.format(path_simulation_folder_)
    if _are_targets_ is not None:
        argument = argument + ' -t "{}"'.format(int(_are_targets_))
    if type(keep_context_) is bool:
        argument = argument + ' --keep_context "{}"'.format(int(keep_context_))
    # Add the name of the component to the argument
    argument = argument + " -c {}".format(ghenv.Component.NickName)
    # Run the bat file
    output = os.system(command + argument)
    # Delete the folder with the honeybee models converted to json
    shutil.rmtree(path_folder_honeybee_json)

# Read the log file
report = read_logs(path_simulation_folder_)
# ---------- end loadhbm ----------

# ----
# Load target Buildings from HB Models
load_target_buildings_from_hb_models = Button()
loadhbm_2 = BUALoadHBModelInUrbanCanopy(
    path_simulation_folder=filter,
    hb_model_list=flatten(item),
    are_targets=Toggle(True),
    keep_context=Toggle(False),
    run=load_target_buildings_from_hb_models)  # -> report, path_simulation_folder; inputs hb_model_list: list, are_targets: Boolean, keep_context: Boolean, run: Boolean; same code as loadhbm

# ----
# Plot HB Models of BuildingModeled from Urban Canopy
falsestart_3 = LBFalseStartToggle(False)
gethbmodels = BUAGetHBModels(path_simulation_folder=filter, run=falsestart_3)  # -> hb_model_list; inputs building_id_list: list
# ---------- gethbmodels: Python ----------
"""Get the HB models from the urban canopy json file
    Inputs:
        path_simulation_folder_: Path to the simulation folder
        _building_id_list_ : List of the building id to get teh HB models. If empty, get all the HB models.
        _run : Plug a boolean toggle. Put it to true if we want to run the code.
    Output:
        hb_model_list: List of the HB models"""

__author__ = "elie-medioni"
__version__ = "2024.05.05"

ghenv.Component.Name = "BUA Get HB Models"
ghenv.Component.NickName = 'GetHBModels'
ghenv.Component.Category = 'BUA'
ghenv.Component.SubCategory = '2 :: Information'
ghenv.Component.AdditionalHelpFromDocStrings = "1"


import json
import os

from honeybee.model import Model

# Get Appdata\local folder
local_appdata = os.environ['LOCALAPPDATA']
path_tool = os.path.join(local_appdata, "Building_urban_analysis")

# set default value for the simulation folder if not provided
if path_simulation_folder_ is None:
    path_simulation_folder_ = os.path.join(path_tool, "Simulation_temp")

path_json = os.path.join(path_simulation_folder_, "urban_canopy.json")

if _run and os.path.isfile(path_json):

    path_json = os.path.join(path_simulation_folder_, "urban_canopy.json")
    with open(path_json, "r") as f:
        urban_canopy_dict = json.load(f)
    # Get the list of the building ids to display
    if _building_id_list_ == [] or _building_id_list_ is None:
        _building_id_list_ = []
        # add the id of the target building
        for building_id in list(urban_canopy_dict["buildings"].keys()):
            if urban_canopy_dict["buildings"][building_id]["type"] == "BuildingModeled":
                _building_id_list_.append(building_id)
    else:  # Check if the building ids are in the json file
        for building_id in _building_id_list_:
            try:
                urban_canopy_dict["buildings"][building_id]
            except KeyError:
                raise KeyError("Building with ID '{}' not found in the dictionary.".format(building_id))
            else:
                if not urban_canopy_dict["buildings"][building_id]["type"] == "BuildingModeled":
                    raise ValueError(
                        "Building with ID {} does not have a HB model and thus not shades".format(
                            building_id))

    hb_model_list = []
    for building_id in _building_id_list_:
        if urban_canopy_dict["buildings"][building_id]["hb_model"] is not None:
            hb_model_list.append(Model.from_dict(urban_canopy_dict["buildings"][building_id]["hb_model"]))

if not os.path.isfile(path_json):
    print("the json file of the urban canopy does not exist")
# ---------- end gethbmodels ----------
vizall = HBVisualizeAll(hb_objs=flatten(gethbmodels))  # -> geo; plug-in component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

# ----
# Generate a version of the HB Model with merged coplanar faces
toggle = BooleanToggle(True)
mergefaceparameters = BUAMergeFaceParameters(orient_roof_according_to_building_orientation=toggle)  # -> out, merge_face_parameters; inputs orient_roof_according_to_building_orientation: Boolean, overwrite: Boolean
# ---------- mergefaceparameters: Python ----------
"""Parameters for the merging face algorithm.
    Inputs:
        _orient_roof_according_to_building_orientation_: bool: default=True if True, the roof mesh will be oriented
        according to the building orientation, usefull especially when generating a mesh for the solar radiation.
        _north_angle_: float : default=0: angle of the north in degrees compared to orientation of the HB model
        _overwrite_: bool: default=False: if True, the existing merged faces will be overwritten
    Output:
        replacement_scenario_parameters_dict: Dictionary containing the parameters for the BIPV replacement scenarios"""

__author__ = "elie-medioni"
__version__ = "2023.09.06"

ghenv.Component.Name = "BUA Merge Face Parameters"
ghenv.Component.NickName = 'MergeFaceParameters'
ghenv.Component.Message = '0.0.0'
ghenv.Component.Category = 'BUA'
ghenv.Component.SubCategory = '2 :: Building manipulation'

import json

# Check if the parameters are valid
if _north_angle_ is not None and not 0<=_north_angle_<=360:
    raise ValueError("The north angle is not valid, it should be between 0 and 360 degrees")

merge_face_parameters= {"orient_roof_according_to_building_orientation": _orient_roof_according_to_building_orientation_,
                        "north_angle": _north_angle_,
                        "overwrite": _overwrite_}

merge_face_parameters = json.dumps(merge_face_parameters)
# ---------- end mergefaceparameters ----------
mergebuildingfaces = BUAMergeBuildingFaces(path_simulation_folder=filter, merge_face_parameters=mergefaceparameters.merge_face_parameters, run=Button())  # -> report, path_simulation_folder; inputs building_id_list: list, run: Boolean
# ---------- mergebuildingfaces: Python ----------
"""Generate a version of the HB model of the building with merged faces. It is useful to ignore the subdivisions
of floors and apartment. It can be used for the context selection and generate the mesh for the solar radiation simulation.
Only BuildingModelled objects (with a Honeybee Model) can generate a merged face HB Model.
    Inputs:
        path_simulation_folder_: Path to the folder. Default = Appdata\Local\Building_urban_analysis\Simulation_temp
        building_id_list_: list of buildings we want to run the simulation on. If set to None, it will be run on
        all the buildings.
        _merge_face_parameters_: Dictionary of parameters to merge the faces. You can plug the dedicated BUA Merge Face
        component. If empty, the default parameters will be used.
        _run: Plug in a button to run the component
    Output:
        report: logs
        path_simulation_folder_: Path to the folder."""

__author__ = "elie-medioni"
__version__ = "2024.05.07"

ghenv.Component.Name = "BUA Merge Building Faces"
ghenv.Component.NickName = 'MergeBuildingFaces'
ghenv.Component.Category = 'BUA'
ghenv.Component.SubCategory = '3 :: Building manipulation'

import os
import json


def clean_path(path):
    path = path.replace("\\", "/")
    return (path)


def read_logs(path_simulation_folder):
    path_log_file = os.path.join(path_simulation_folder_, "gh_components_logs",
                                 ghenv.Component.NickName + ".log")
    if os.path.isfile(path_log_file):
        with open(path_log_file, 'r') as log_file:
            log_data = log_file.read()
        return (log_data)
    else:
        return ("No log file found")


# Get Appdata\local folder
local_appdata = os.environ['LOCALAPPDATA']
path_tool = os.path.join(local_appdata, "Building_urban_analysis")
path_bat_file = os.path.join(path_tool, "Scripts", "mains_tool", "run_BUA.bat")

# Check path_simulation_folder_
if path_simulation_folder_ is None:
    path_simulation_folder_ = os.path.join(path_tool, "Simulation_temp")
elif os.path.isdir(path_simulation_folder_) is False:
    raise ValueError("The simulation folder does not exist, enter a valid path")

# Path to the urban canopy json file
path_json = os.path.join(path_simulation_folder_, "urban_canopy.json")

# Check _bipv_parameters
if _merge_face_parameters_ is not None:
    try:  # try to load the json
        merge_face_parameters_dict = json.loads(_merge_face_parameters_)
    except:
        raise ValueError("The _merge_face_parameters_ is not valid, use the BUA Merge Face component as input")
    if not (isinstance(merge_face_parameters_dict, dict)
            or "orient_roof_according_to_building_orientation" not in merge_face_parameters_dict.keys()
            or "north_angle" not in merge_face_parameters_dict.keys()
            or "overwrite" not in merge_face_parameters_dict.keys()):
        raise ValueError("The _merge_face_parameters_ is not valid, use the BUA Merge Face component as input")
    else:
        orient_roof_according_to_building_orientation = merge_face_parameters_dict[
            "orient_roof_according_to_building_orientation"]
        north_angle = merge_face_parameters_dict["north_angle"]
        overwrite = merge_face_parameters_dict["overwrite"]
else:
    orient_roof_according_to_building_orientation = None
    north_angle = None
    overwrite = None

if _run:
    # Write the command
    command = path_bat_file
    # Steps to execute
    argument = " "
    argument = argument + "--make_simulation_folder 1 " + "--create_or_load_urban_canopy_object 1 " + "--save_urban_canopy_object_to_pickle 1 " + "--save_urban_canopy_object_to_json 1 " + "--make_merged_faces_hb_model 1 "
    # OPtionnal argument of the bat file/Python script
    if path_simulation_folder_ is not None:
        argument = argument + ' -f "{}"'.format(path_simulation_folder_)
    if building_id_list_ is not None and building_id_list_ != []:
        argument = argument + ' --building_id_list "{}"'.format(building_id_list_)
    if orient_roof_according_to_building_orientation is not None:
        argument = argument + " --orient_roof_according_to_building_orientation {}".format(
            int(orient_roof_according_to_building_orientation))
    if north_angle is not None:
        argument = argument + " --north_angle {}".format(float(north_angle))
    if overwrite is not None:
        argument = argument + " --overwrite {}".format(int(overwrite))

    # Add the name of the component to the argument
    argument = argument + " -c {}".format(ghenv.Component.NickName)
    # Run the bat file
    output = os.system(command + argument)

# set default value for the simulation folder if not provided
if path_simulation_folder_ is None:
    path_simulation_folder_ = os.path.join(path_tool, "Simulation_temp")

# Read the log file
report = read_logs(path_simulation_folder_)
# ---------- end mergebuildingfaces ----------

# ----
# Generate Bounding Boxes of Buildings
button_2 = Button()
generateboundingboxes = BUAGenerateBoundingBoxes(path_simulation_folder=filter, run=button_2)  # -> report, path_simulation_folder; inputs overwrite: Boolean
#   port overwrite: bool: Put to True if the context filtering should be run again for buildings for which it was already performed, otherwise the existing filtering will remain. Mandatory if new buildings were added.
# ---------- generateboundingboxes: Python ----------
""" Generate the bounding boxes buildings for context selection algorithm.
    Inputs:
        path_simulation_folder_: Path to the simulation folder. Default = Appdata\Local\Building_urban_analysis\Simulation_temp
        _overwrite_: Set to True to overwrite the existing bounding boxes. Default = False
        _run: Plug in a button to run the component
    Output:
        report: logs
        path_simulation_folder_: Path to the folder."""


__author__ = "elie-medioni"
__version__ = "2023.12.27"

ghenv.Component.Name = "BUA Generate Bounding Boxes"
ghenv.Component.NickName = 'GenerateBoundingBoxes'
ghenv.Component.Category = 'BUA'
ghenv.Component.SubCategory = '4 :: Context Selection'

import os


def clean_path(path):
    path = path.replace("\\", "/")
    return (path)


def read_logs(path_simulation_folder):
    path_log_file = os.path.join(path_simulation_folder_, "gh_components_logs",
                                 ghenv.Component.NickName + ".log")
    if os.path.isfile(path_log_file):
        with open(path_log_file, 'r') as log_file:
            log_data = log_file.read()
        return (log_data)
    else:
        return ("No log file found")


# Check path_simulation_folder_
if path_simulation_folder_ is not None and os.path.isdir(path_simulation_folder_) is False:
    raise ValueError("The simulation folder does not exist, enter a valid path")

# Get Appdata\local folder
local_appdata = os.environ['LOCALAPPDATA']
path_tool = os.path.join(local_appdata, "Building_urban_analysis")
path_bat_file = os.path.join(path_tool, "Scripts", "mains_tool", "run_BUA.bat")

if _run:
    # Write the command
    command = path_bat_file
    # Steps to execute
    argument = " "
    argument = argument + "--make_simulation_folder 1 " + "--create_or_load_urban_canopy_object 1 " + "--save_urban_canopy_object_to_pickle 1 " + "--save_urban_canopy_object_to_json 1 " + "--generate_bounding_boxes 1 "
    # OPtionnal argument of the bat file/Python script
    if path_simulation_folder_ is not None:
        argument = argument + ' -f "{}"'.format(path_simulation_folder_)
    if overwrite_ is not None:
        argument = argument + " --overwrite {}".format(int(overwrite_))

    # Add the name of the component to the argument
    argument = argument + " -c {}".format(ghenv.Component.NickName)
    # Run the bat file
    output = os.system(command + argument)

# set default value for the simulation folder if not provided
if path_simulation_folder_ is None:
    path_simulation_folder_ = os.path.join(path_tool, "Simulation_temp")

# Read the log file
report = read_logs(path_simulation_folder_)
# ---------- end generateboundingboxes ----------
falsestart_4 = LBFalseStartToggle(False)
plotboundingboxes = BUAPlotBoundingBoxes(path_simulation_folder=generateboundingboxes.path_simulation_folder, run=falsestart_4)  # -> building_id_list, bounding_box_list; inputs building_id_list: list
#   port building_id_list: list of the building id to get teh HB models. If empty, get all the HB models.
# ---------- plotboundingboxes: Python ----------
"""Plot the bounding boxes of the buildings inside the Urban Canopy. For the context selection algorithm.
    Inputs:
        path_simulation_folder_: Path to the folder. By default, the code will be run in
                                Appdata\Local\Building_urban_analysis\Simulation_temp
        building_id_list_: List of building ids to display. If empty, all the buildings will be displayed.
        _run : Plug a boolean toggle to True to run the code and display the results.
    Output:
        bounding_box_list : Brep of the bounding_boxes of the target building
        building_id_list : List of the ids of the buildings
"""

__author__ = "elie-medioni"
__version__ = "2023.12.22"

ghenv.Component.Name = "BUA Plot Bounding Boxes"
ghenv.Component.NickName = 'PlotBoundingBoxes'
ghenv.Component.Category = 'BUA'
ghenv.Component.SubCategory = '4 :: Context Selection'

import json
import os

from ladybug_rhino.fromgeometry import from_polyface3d
from ladybug_geometry.geometry3d.polyface import Polyface3D


def clean_path(path):
    path = path.replace("\\", "/")
    return (path)


# Get Appdata\local folder
local_appdata = os.environ['LOCALAPPDATA']
path_tool = os.path.join(local_appdata, "Building_urban_analysis")

# set default value for the simulation folder if not provided
if path_simulation_folder_ is None:
    path_simulation_folder_ = os.path.join(path_tool, "Simulation_temp")

path_json = os.path.join(path_simulation_folder_, "urban_canopy.json")

# Run the code if the _run input is set to True
if _run and os.path.isfile(path_json):

    # Read the json file
    with open(path_json, 'r') as json_file:
        urban_canopy_dict = json.load(json_file)

    # Get the list of the building ids to display
    if _building_id_list == [] or _building_id_list is None:
        _building_id_list = list(urban_canopy_dict["buildings"].keys())
    else: # Check if the building ids are in the json file
        for building_id in _building_id_list:
            try :
                urban_canopy_dict["buildings"][building_id]
            except KeyError:
                raise KeyError("Building with ID '{}' not found in the dictionary.".format(building_id))

    # Init
    bounding_box_list = []

    for building_id in _building_id_list:
        # Check if the building has a bounding box
        if urban_canopy_dict["buildings"][building_id]["lb_polyface3d_oriented_bounding_box"] is not None:
            # Convert the dictionnary to a polyface3d then to a brep
            bounding_box_list.append(from_polyface3d(
                Polyface3D.from_dict(urban_canopy_dict["buildings"][building_id]["lb_polyface3d_oriented_bounding_box"])))
    if len(bounding_box_list) == 0:
        print("No bounding box was found. The bounding boxes were not generated. "
              "Generate them with the dedicated component or run context filtering if needed, "
              "it generates the bounding boxes automatically.")

    # Set the ids of teh buildings as output, to know which building is which
    building_id_list = _building_id_list

if not os.path.isfile(path_json):
    print("The json file of the urban canopy does not exist")
# ---------- end plotboundingboxes ----------
brep_4 = Brep(plotboundingboxes.bounding_box_list)
preview_4 = CustomPreview(Geometry=brep_4, Material=ColourSwatch(SwatchColor=RGBA(177, 194, 70, 160)))

# ----
# Perform Shading Context Selection
button_3 = Button()
performfirstpasscontextselection = BUAPerformFirstPassContextSelection(path_simulation_folder=filter, min_vf_criterion="0.01", overwrite=Toggle(True), run=button_3)  # -> out, report, path_simulation_folder; inputs building_id_list: list, overwrite: Boolean
# ---------- performfirstpasscontextselection: Python ----------
"""Perform the first pass of the context selection. Select the building that will be kept for the second step of filtering based on estimation of the supremum of the view factor of between the building faces andcontext bounding boxes.
It will automatically generate the bounding boxes of all the buildings if not done already.
    Inputs:
        path_simulation_folder_: Path to the simulation folder. Default = Appdata\Local\Building_urban_analysis\Simulation_temp
        building_id_list_: List of buildings we want to run the simulation on. If set to None, it will be run
        on the target buildings.
        _min_vf_criterion_: Minimum view factor criterion (in ]1:0[ ) of a surface of a context building boundary box
        to be kept for the second pass (Default = 0.01). If you want all buildings to be selected, just input a very low
        value, like 0.00001. Look at the documentation for more detailed explanation about the filtering process.
        _overwrite_: Set to True if the context filtering should be run again for buildings for which
        it was already performed, otherwise the existing filtering will remain. Mandatory if new buildings were added.
        _run: Plug in a button to run the component
    Output:
        report: logs
        path_simulation_folder_: Path to the folder."""


__author__ = "elie-medioni"
__version__ = "2024.05.27"

from ghpythonlib.componentbase import executingcomponent as component


ghenv.Component.Name = "BUA Perform First Pass Context Selection"
ghenv.Component.NickName = 'PerformFirstPassContextSelection'
ghenv.Component.Message = '1.1.0'
ghenv.Component.Category = 'BUA'
ghenv.Component.SubCategory = '4 :: Context Selection'


import os
import json

def clean_path(path):
    path = path.replace("\\", "/")
    return (path)


def read_logs(path_simulation_folder):
    path_log_file = os.path.join(path_simulation_folder_, "gh_components_logs",
                                 ghenv.Component.NickName + ".log")
    if os.path.isfile(path_log_file):
        with open(path_log_file, 'r') as log_file:
            log_data = log_file.read()
        return (log_data)
    else:
        return ("No log file found")



# Get Appdata\local folder
local_appdata = os.environ['LOCALAPPDATA']
path_tool = os.path.join(local_appdata, "Building_urban_analysis")
path_bat_file = os.path.join(path_tool, "Scripts", "mains_tool", "run_BUA.bat")

# Check path_simulation_folder_
if path_simulation_folder_ is None:
    path_simulation_folder_ = os.path.join(path_tool, "Simulation_temp")
elif os.path.isdir(path_simulation_folder_) is False:
    raise ValueError("The simulation folder does not exist, enter a valid path")

# Path to the urban canopy json file
path_json = os.path.join(path_simulation_folder_, "urban_canopy.json")

# Check the _min_vf_criterion_
if _min_vf_criterion_ is not None:
    if not 0<_min_vf_criterion_ <1:
        raise ValueError("The minimum view factor criterion should be in ]0:1[ range.")

if _run:

    # Check if the urban canopy json file exists
    if not os.path.isfile(path_json):
        raise ValueError("The urban canopy json file does not exist, buildings need to be loaded before running the context selection.")

    # Check if the building id list is not empty
    with open(path_json, "r") as f:
        urban_canopy_dict = json.load(f)
    if building_id_list_ == [] or building_id_list_ is None:
        pass
    else:  # Check if the building ids are in the json file
        for building_id in building_id_list_:
            try:
                urban_canopy_dict["buildings"][building_id]
            except KeyError:
                raise KeyError("Building with ID '{}' not found in the dictionary.".format(building_id))

    # Write the command
    command = path_bat_file
    # Steps to execute
    argument = " "
    argument = argument + "--make_simulation_folder 1 " + "--create_or_load_urban_canopy_object 1 " + "--save_urban_canopy_object_to_pickle 1 " + "--save_urban_canopy_object_to_json 1 " + "--run_first_pass_context_filtering 1 "
    # OPtionnal argument of the bat file/Python script
    if path_simulation_folder_ is not None:
        argument = argument + ' -f "{}"'.format(path_simulation_folder_)
    if building_id_list_ is not None and building_id_list_ != []:
        argument = argument + ' --building_id_list "{}"'.format(building_id_list_)
    if _min_vf_criterion_ is not None:
        argument = argument + " --min_vf_criterion {}".format(float(_min_vf_criterion_))
    if _overwrite_ is not None:
        argument = argument + " --overwrite {}".format(int(_overwrite_))

    # Add the name of the component to the argument
    argument = argument + " -c {}".format(ghenv.Component.NickName)
    # Run the bat file
    output = os.system(command + argument)


# Read the log file
report = read_logs(path_simulation_folder_)
# ---------- end performfirstpasscontextselection ----------
performsecondpasscontextselection = BUAPerformSecondPassContextSelection(
    path_simulation_folder=performfirstpasscontextselection.path_simulation_folder,
    no_ray_tracing=Toggle(False),
    number_of_rays="3",
    consider_windows=Toggle(False),
    keep_discarded_surfaces=Toggle(True),
    overwrite=Toggle(True),
    run=Button())  # -> out, report, path_simulation_folder; inputs building_id_list: list, no_ray_tracing: Boolean, number_of_rays: Int32, consider_windows: Boolean, overwrite: Boolean
# ---------- performsecondpasscontextselection: Python ----------
"""Perform the second pass of context selection. The first pass needs to be performed before running the second pass.
Note that it does not add the shades directly to the Honeybee Model of the buildings, they are stored separately,
but they are used in all the following steps of the simulation implying the shades.
    Inputs:
        path_simulation_folder_: Path to the simulation folder. Default = Appdata\Local\Building_urban_analysis\Simulation_temp
        building_id_list_: list of buildings we want to run the simulation on. If set to None, it will be run
        on the target buildings.
        _number_of_rays_: int: Number of rays to be used for the ray tracing, can be either 1,3 or 9. Default = 3,
        _consider_windows_: Set to True if the windows should be considered as potential shades.
        If so it will consider the reflexivity of the window material. Note that it can increase significantly the number of context surfaces and thus slow down the simulation.
        If set to false, only the facades, with their associated reflexivity will be considered. (Default = False)
        _no_ray_tracing_: Set to True if the ray tracing should not be performed for the context selection, it will just
        add all the surfaces of the selected context buildings as shades.
        _keep_discarded_surfaces_: Set to True if the discarded surfaces should be stored to be displayed later on.
        It can potentially slow down the simulation and increase significantly the size of the result files.
        _overwrite_: Set to True if the context selection should be run again for buildings for which
        it was already performed, otherwise the existing selection will remain. Mandatory if new buildings were added.
        _run: Plug in a button to run the component
    Output:
        report: logs
        path_simulation_folder_: Path to the folder."""

__author__ = "elie-medioni"
__version__ = "2024.05.27"

from ghpythonlib.componentbase import executingcomponent as component


ghenv.Component.Name = "BUA Perform Second Pass Context Selection"
ghenv.Component.NickName = 'PerformSecondPassContextSelection'
ghenv.Component.Message = '1.1.0'
ghenv.Component.Category = 'BUA'
ghenv.Component.SubCategory = '4 :: Context Selection'

import os
import json


def clean_path(path):
    path = path.replace("\\", "/")
    return (path)


def read_logs(path_simulation_folder):
    path_log_file = os.path.join(path_simulation_folder_, "gh_components_logs",
                                 ghenv.Component.NickName + ".log")
    if os.path.isfile(path_log_file):
        with open(path_log_file, 'r') as log_file:
            log_data = log_file.read()
        return (log_data)
    else:
        return ("No log file found")


# Get Appdata\local folder
local_appdata = os.environ['LOCALAPPDATA']
path_tool = os.path.join(local_appdata, "Building_urban_analysis")
path_bat_file = os.path.join(path_tool, "Scripts", "mains_tool", "run_BUA.bat")

# Check path_simulation_folder_
if path_simulation_folder_ is None:
    path_simulation_folder_ = os.path.join(path_tool, "Simulation_temp")
elif os.path.isdir(path_simulation_folder_) is False:
    raise ValueError("The simulation folder does not exist, enter a valid path")

# Path to the urban canopy json file
path_json = os.path.join(path_simulation_folder_, "urban_canopy.json")

# Check if number of rays is correct
if _number_of_rays_ not in [None,1, 3, 9]:
    raise ValueError("The number of rays should be either 1, 3 or 9")

if _run :

    # Check if the urban canopy json file exists
    if not os.path.isfile(path_json):
        raise ValueError("The urban canopy json file does not exist, buildings need to be loaded before running the context selection.")

    # Check if the building id list is not empty
    with open(path_json, "r") as f:
        urban_canopy_dict = json.load(f)
    if building_id_list_ == [] or building_id_list_ is None:
        pass
    else:  # Check if the building ids are in the json file
        for building_id in building_id_list_:
            try:
                urban_canopy_dict["buildings"][building_id]
            except KeyError:
                raise KeyError("Building with ID '{}' not found in the dictionary.".format(building_id))
    # Write the command
    command = path_bat_file
    # Steps to execute
    argument = " "
    argument = argument + "--make_simulation_folder 1 " + "--create_or_load_urban_canopy_object 1 " + "--save_urban_canopy_object_to_pickle 1 " + "--save_urban_canopy_object_to_json 1 " + "--run_second_pass_context_filtering 1 "
    # OPtionnal argument of the bat file/Python script
    if path_simulation_folder_ is not None:
        argument = argument + ' -f "{}"'.format(path_simulation_folder_)
    if building_id_list_ is not None and building_id_list_ != []:
        argument = argument + ' --building_id_list "{}"'.format(building_id_list_)
    # if _on_building_to_simulate_ is not None:  # This option can be added in the future, but it might confuse the user
    #     argument = argument + " --on_building_to_simulate {}".format(int(_on_building_to_simulate_))
    if _number_of_rays_ is not None:
        argument = argument + " --number_of_rays {}".format(int(_number_of_rays_))
    if _consider_windows_ is not None:
        argument = argument + " --consider_windows {}".format(int(_consider_windows_))
    # if _keep_shades_from_user_ is not None:  # This option can be added in the future, but it might confuse the user so the choice of deleting the shades forced by the user will be done when loading the buildings.
    #     argument = argument + " --keep_shades_from_user {}".format(int(_keep_shades_from_user_))
    if _no_ray_tracing_ is not None:
        argument = argument + " --no_ray_tracing {}".format(int(_no_ray_tracing_))
    if _keep_discarded_surfaces_ is not None:
        argument = argument + " --keep_discarded_faces {}".format(int(_keep_discarded_surfaces_))
    if _overwrite_ is not None:
        argument = argument + " --overwrite {}".format(int(_overwrite_))

    # Add the name of the component to the argument
    argument = argument + " -c {}".format(ghenv.Component.NickName)
    # Run the bat file
    output = os.system(command + argument)


# Read the log file
report = read_logs(path_simulation_folder_)
# ---------- end performsecondpasscontextselection ----------

# ----
# Visualize Selected Context
falsestart_5 = LBFalseStartToggle(True)
readcontextfilteringresults = BUAReadContextFilteringResults(path_simulation_folder=performsecondpasscontextselection.path_simulation_folder, run=falsestart_5)  # -> out, read_building_id_list, forced_shade_from_user_tree, first_pass_selected_building_id_tree, first_pass_discarded_building_id_tree, second_pass_selected_hb_shade_tree, second_pass_discarded_surface_tree; inputs building_id_list: list
# ---------- readcontextfilteringresults: Python ----------
"""Read the results of the context filtering. The results are seperated for the first and second pass of the filtering.
Please refer to the documentation for more information about the context filtering method.
Note that the shades are not added the HB model of the Building objects. They are used during all the relevant
simulations, but they can hinder some operations and displays and are thus not added to the HB model.
    Inputs:
        path_simulation_folder_: Path to the folder. By default, the code will be run in
                                Appdata\Local\Building_urban_analysis\Simulation_temp
        _building_id_list_: List of building ids to read. If empty, the result will be read for all target buildings.
        _run : Plug a boolean toggle to True to run the code and display the results.
    Output:
        read_building_id_list : List of the ids of the buildings that were read
        forced_shade_from_user_tree : Tree of the list of forced hb shades for each read building. Forced shades can be
            added with the dedicated component or while loading the HB model in the BUA with the option "keep_context" to True.
        first_pass_selected_building_id_tree : Tree of the list of selected buildings ids for each read building (first pass).
        first_pass_discarded_building_id_tree : Tree of the list of discarded faces for each read building (first pass).
        second_pass_selected_hb_shade_tree : Tree of the list of selected HB shades for each read building (second pass).
            Can be converted to brep for easier display.
        second_pass_discarded_surface_tree : Tree of the list of discarded faces for each read building (second pass).
"""

__author__ = "elie-medioni"
__version__ = "2024.05.07"

ghenv.Component.Name = "BUA Read Context Filtering Results"
ghenv.Component.NickName = 'ReadContextFilteringResults'
ghenv.Component.Category = 'BUA'
ghenv.Component.SubCategory = '4 :: Context Selection'

import json
import os

import ghpythonlib.treehelpers as th
from ladybug_rhino.fromgeometry import from_face3d
from ladybug_geometry.geometry3d.face import Face3D

from honeybee.shade import Shade


def clean_path(path):
    path = path.replace("\\", "/")
    return (path)


# Get Appdata\local folder
local_appdata = os.environ['LOCALAPPDATA']
path_tool = os.path.join(local_appdata, "Building_urban_analysis")

# Check path_simulation_folder_
if path_simulation_folder_ is None:
    path_simulation_folder_ = os.path.join(path_tool, "Simulation_temp")
elif os.path.isdir(path_simulation_folder_) is False:
    raise ValueError("The simulation folder does not exist, enter a valid path")

# Path to the urban canopy json file
path_json = os.path.join(path_simulation_folder_, "urban_canopy.json")


# Run the code
if _run:
    # Check if the urban canopy json file exists
    if not os.path.isfile(path_json):
        raise ValueError(
            "The urban canopy json file does not exist, buildings need to be loaded before running the context selection.")
    # Read the json file
    with open(path_json, 'r') as json_file:
        urban_canopy_dict = json.load(json_file)

    # Get the list of the building ids to display
    if _building_id_list_ == [] or _building_id_list_ is None:
        # add the id of the buildings that have been run if no list is provided
        _building_id_list_ = [building_id for building_id in urban_canopy_dict["buildings"].keys() if
                             (urban_canopy_dict["buildings"][building_id]["type"] == "BuildingModeled" and
                              urban_canopy_dict["buildings"][building_id]["context_surfaces"]["first_pass_done"])]

    else:  # Check if the building ids are in the json file
        for building_id in _building_id_list_:
            try:
                urban_canopy_dict["buildings"][building_id]
            except KeyError:
                raise KeyError("Building with ID '{}' not found in the dictionary.".format(building_id))
            else:
                if not urban_canopy_dict["buildings"][building_id]["type"] == "BuildingModeled":
                    raise ValueError(
                        "Building with ID {} does not have a HB model, a context filtering cannot be performed on it".format(
                            building_id))
                elif not urban_canopy_dict["buildings"][building_id]["context_surfaces"]["first_pass_done"]:
                    raise ValueError("Context filtering for building ID {} was not performed".format(building_id))

    # Init
    forced_shade_from_user_tree = []
    first_pass_selected_building_id_tree = []
    first_pass_discarded_building_id_tree = []
    second_pass_selected_hb_shade_tree = []
    second_pass_discarded_surface_tree = []
    read_building_id_list = _building_id_list_

    for building_id in _building_id_list_:
        # Check if the building has forced shades and add the list of forced HB Shades
        if urban_canopy_dict["buildings"][building_id]["context_surfaces"]["forced_hb_shades_from_user_list"] is not None:
            forced_shade_from_user_tree.append([Shade.from_dict(shade) for shade in
                                                urban_canopy_dict["buildings"][building_id]["context_surfaces"][
                                                    "forced_hb_shades_from_user_list"]])
        else:
            forced_shade_from_user_tree.append([])
        # Check if the building first pass of the context filtering was done and add the selected building ids
        if urban_canopy_dict["buildings"][building_id]["context_surfaces"]["first_pass_done"]:
            first_pass_selected_building_id_tree.append(
                urban_canopy_dict["buildings"][building_id]["context_surfaces"]["selected_context_building_id_list"])
            # make a list of discarded building ids
            first_pass_discarded_building_id_tree.append(
                [id for id in list(urban_canopy_dict["buildings"].keys()) if
                 (id not in first_pass_selected_building_id_tree[-1] and id != building_id)])
        else:
            first_pass_selected_building_id_tree.append([])
            print(
                "The first pass of the context filtering was not done for the building with id {}".format(building_id))
        # Check if the building second pass of the context filtering was done and add the selected HB shades
        if urban_canopy_dict["buildings"][building_id]["context_surfaces"]["second_pass_done"]:
            second_pass_selected_hb_shade_tree.append([Shade.from_dict(shade) for shade in
                                                       urban_canopy_dict["buildings"][building_id]["context_surfaces"][
                                                           "context_shading_hb_shade_list"]])
            if urban_canopy_dict["buildings"][building_id]["context_surfaces"][
                "discarded_lb_face3d_context_shading_second_pass_list"] is not None:
                second_pass_discarded_surface_tree.append([from_face3d(Face3D.from_dict(face)) for face in
                                                           urban_canopy_dict["buildings"][building_id][
                                                               "context_surfaces"][
                                                               "discarded_lb_face3d_context_shading_second_pass_list"]])
            else:
                second_pass_discarded_surface_tree.append([])
                print(
                    "The the option to keep the discarded surfaces for the second pass of the context filtering was " \
                    "not done for the building with id {}".format(building_id))
        else:
            second_pass_selected_hb_shade_tree.append([])
            print(
                "The second pass of the context filtering was not done for the building with id {}".format(building_id))

    # Convert to tree
    forced_shade_from_user_tree = th.list_to_tree(forced_shade_from_user_tree)
    first_pass_selected_building_id_tree = th.list_to_tree(first_pass_selected_building_id_tree)
    first_pass_discarded_building_id_tree = th.list_to_tree(first_pass_discarded_building_id_tree)
    second_pass_selected_hb_shade_tree = th.list_to_tree(second_pass_selected_hb_shade_tree)
    second_pass_discarded_surface_tree = th.list_to_tree(second_pass_discarded_surface_tree)

if not os.path.isfile(path_json):
    print("the json file of the urban canopy does not exist")
# ---------- end readcontextfilteringresults ----------
panel_4 = Panel(readcontextfilteringresults.read_building_id_list)
bang = ExplodeTree(Data=readcontextfilteringresults.first_pass_selected_building_id_tree)  # -> Branch0, Branch1, Branch2
bang_2 = ExplodeTree(Data=readcontextfilteringresults.first_pass_discarded_building_id_tree)  # -> Branch0, Branch1, Branch2
bang_3 = ExplodeTree(Data=readcontextfilteringresults.second_pass_selected_hb_shade_tree)  # -> Branch0, Branch1, Branch2
bang_4 = ExplodeTree(Data=readcontextfilteringresults.second_pass_discarded_surface_tree)  # -> Branch0, Branch1, Branch2
target_building_index = Slider(2, range=0..2)
filter_2 = StreamFilter(Gate=target_building_index, Stream0=bang.Branch0, Stream1=bang.Branch1, Stream2=bang.Branch2)
filter_3 = StreamFilter(Gate=target_building_index, Stream0=bang_2.Branch0, Stream1=bang_2.Branch1, Stream2=bang_2.Branch2)
filter_4 = StreamFilter(Gate=target_building_index, Stream0=bang_3.Branch0, Stream1=bang_3.Branch1, Stream2=bang_3.Branch2)
filter_5 = StreamFilter(Gate=target_building_index, Stream0=bang_4.Branch0, Stream1=bang_4.Branch1, Stream2=bang_4.Branch2)
item_3 = ListItem(List=panel_4, Index=target_building_index, Wrap=True)
falsestart_6 = LBFalseStartToggle(False)
falsestart_7 = LBFalseStartToggle(False)
vizall_2 = HBVisualizeAll(hb_objs=flatten(filter_4))  # -> geo; plug-in component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
brep_5 = Brep(filter_5)
loadbuildingenvelopes_2 = BUALoadBuildingEnvelopes(
    path_simulation_folder=performsecondpasscontextselection.path_simulation_folder,
    building_id_list=filter_2,
    run=falsestart_7)  # -> building_hb_rooms, target_building_modeled_envelopes, non_target_building_modeled_envelopes, building_basic_envelopes; inputs building_id_list: list, run: Boolean; same code as loadbuildingenvelopes
loadbuildingenvelopes_3 = BUALoadBuildingEnvelopes(
    path_simulation_folder=performsecondpasscontextselection.path_simulation_folder,
    building_id_list=filter_3,
    run=falsestart_7)  # -> building_hb_rooms, target_building_modeled_envelopes, non_target_building_modeled_envelopes, building_basic_envelopes; inputs building_id_list: list, run: Boolean; same code as loadbuildingenvelopes
gethbmodels_2 = BUAGetHBModels(
    path_simulation_folder=performsecondpasscontextselection.path_simulation_folder,
    building_id_list=item_3,
    run=falsestart_6)  # -> hb_model_list; inputs building_id_list: list; same code as gethbmodels
brep_6 = Brep([loadbuildingenvelopes_2.target_building_modeled_envelopes, loadbuildingenvelopes_2.non_target_building_modeled_envelopes, loadbuildingenvelopes_2.building_basic_envelopes])
brep_7 = Brep([loadbuildingenvelopes_3.building_basic_envelopes, loadbuildingenvelopes_3.non_target_building_modeled_envelopes, loadbuildingenvelopes_3.target_building_modeled_envelopes])

target_building_hb_model = Data(gethbmodels_2)
discarded_hb_shade_second_pass = Data(brep_5)
selected_building_first_pass = Data(brep_6)
discarded_building_first_pass = Data(brep_7)
selected_hb_shade_second_pass = Data(vizall_2)

vizbytype = HBVisualizeByType(hb_objs=target_building_hb_model)  # -> walls, interior_walls, roofs, ceilings, exterior_floors, interior_floors, air_walls, apertures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; plug-in component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
preview_5 = CustomPreview(Geometry=selected_building_first_pass, Material=ColourSwatch(SwatchColor=RGB(44, 115, 191)))
preview_6 = CustomPreview(Geometry=discarded_building_first_pass, Material=ColourSwatch(SwatchColor=RGB(255, 0, 0)))
preview_7 = CustomPreview(Geometry=selected_hb_shade_second_pass, Material=ColourSwatch(SwatchColor=RGB(73, 227, 39)))
preview_8 = CustomPreview(Geometry=discarded_hb_shade_second_pass, Material=ColourSwatch(SwatchColor=RGB(128, 5, 5)))

# ----
# Get UBES results
# Run UBES
falsestart_8 = LBFalseStartToggle(True)
getsampledataforexamplefile_3 = BUAGetSampleDataForExampleFile(run=falsestart_8)  # -> out, path_sample_gis, path_sample_epw_file, path_sample_folder_hbjson, path_sample_hbjson_list, sample_hb_model_list; inputs run: Boolean; same code as getsampledataforexamplefile
simpar = HBSimulationParameter(timestep=6)  # -> sim_par; plug-in component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
cop_cooling = Panel("3")
cop_heating = Panel("3")
runubeswithopenstudio = BUARunUBESWithOpenstudio(
    path_simulation_folder=filter,
    path_weather_file=getsampledataforexamplefile_3.path_sample_epw_file,
    hb_simulation_parameters=simpar,
    cop_cooling=cop_cooling,
    cop_heating=cop_heating,
    overwrite=Toggle(True),
    run=Button())  # -> report, path_simulation_folder; inputs building_id_list: list, overwrite: Boolean, run_in_parallel: Boolean, run: Boolean
# ---------- runubeswithopenstudio: Python ----------
""" Run the Energy simulation with Openstudio and EnergyPlus at the urban scale.
    Inputs:
        path_simulation_folder_: Path to the folder. Default = Appdata\Local\Building_urban_analysis\Simulation_temp
        building_id_list_: list of buildings we want to run the simulation on. If set to None, it will be run on the
        buildings to simulate.
        _path_weather_file: Path to the epw or wea (not sure wea compatible) weather file. Default =
        path_ddy_file_: Path to the ddy file. If no file is provided the design days will be set automatically by Honeybee
         Default = None
        _hb_simulation_parameters : Honeybee simulation parameter object from the Honeybee parameter or a path to
        a Honeybee parameter hbjson file.
        _cop_cooling_: float: Coefficient of performance of the cooling system. Default = 3.
        _cop_heating_: float: Coefficient of performance of the heating system. Default = 3.
        _overwrite_: Set to True if the existing simulation should be overwritten. (Default: True)
        run_in_parallel_: bool: True if the simulations should be run in parallel. (not implemented yet) (Default: False)
        _run: Plug in a button to run the component
    Output:
        report: logs
"""


__author__ = "elie-medioni"
__version__ = "2024.05.28"

ghenv.Component.Name = "BUA Run UBES with Openstudio"
ghenv.Component.NickName = 'RunUBESwithOpenstudio'
ghenv.Component.Message = '1.1.0'
ghenv.Component.Category = 'BUA'
ghenv.Component.SubCategory = '5 :: Energy Simulation'


import os
import json

from honeybee_energy.simulation.parameter import SimulationParameter

def clean_path(path):
    path = path.replace("\\", "/")
    return (path)


def read_logs(path_simulation_folder):
    path_log_file = os.path.join(path_simulation_folder_, "gh_components_logs",
                                 ghenv.Component.NickName + ".log")
    if os.path.isfile(path_log_file):
        with open(path_log_file, 'r') as log_file:
            log_data = log_file.read()
        return (log_data)
    else:
        return ("No log file found")


# Check path_simulation_folder_
if path_simulation_folder_ is not None and os.path.isdir(path_simulation_folder_) is False:
    raise ValueError("The simulation folder does not exist, enter a valid path")

# Get Appdata\local folder
local_appdata = os.environ['LOCALAPPDATA']
path_tool = os.path.join(local_appdata, "Building_urban_analysis")
name_temporary_files_folder = "temporary_files"
path_bat_file = os.path.join(path_tool, "Scripts", "mains_tool", "run_BUA.bat")

# Check the Honeybee simulation parameters
if _hb_simulation_parameters is None:
    # Don't do anything, the default simulation parameters will be used
    pass
elif isinstance(_hb_simulation_parameters,SimulationParameter):
    if path_simulation_folder_ is None:
        path_simulation_folder = os.path.join(path_tool, "Simulation_temp")
    # Save the simulation parameter to a file
    path_hbjson_simulation_parameter_file = os.path.join(path_simulation_folder,name_temporary_files_folder, "simulation_parameters.json")
elif isinstance(_hb_simulation_parameters,str) :
    # Check if the file exists
    if not os.path.isfile(_hb_simulation_parameters):
        raise FileNotFoundError("The simulation parameter file inputed does not exist.")
    # Check if the file contains a valid Honeybee simulation parameters object
    try:
        with open(_hb_simulation_parameters, 'r') as f:
            json_dic = json.load(f)
        SimulationParameter.from_dict(json_dic)
    except:
        raise ValueError("The simulation parameter file is not valid, it cannot be loaded.")

    path_hbjson_simulation_parameter_file = _hb_simulation_parameters
else:
    raise ValueError("The simulation parameter is not valid. Please input the path to a Honeybee simulation parameter file or a Honeybee simulation parameter object")

# Check if the weather file exists
if _path_weather_file is not None and not os.path.isfile(_path_weather_file):
    raise FileNotFoundError("The weather file does not exist, enter a valid path")
# Check if the ddy file exists
if path_ddy_file_ is not None and not os.path.isfile(path_ddy_file_):
    raise FileNotFoundError("The ddy file does not exist, enter a valid path")

# Check the COPs
if (_cop_cooling_ is not None and _cop_cooling_ <= 0) or (_cop_heating_ is not None and _cop_heating_ <= 0):
    raise ValueError("The COP should be greater than 0")

# Set _overwrite_ to True if it is not provided
if _overwrite_ is None:
    _overwrite_ = True

if _run:
    # Convert the simulation parameters to hbjson if it is not already
    print(type(_hb_simulation_parameters))
    if isinstance(_hb_simulation_parameters, SimulationParameter):
        hb_simulation_parameters_dict = _hb_simulation_parameters.to_dict()
        with open(path_hbjson_simulation_parameter_file,"w") as json_file:
            json.dump(hb_simulation_parameters_dict,json_file)
    # Write the command
    command = path_bat_file
    # Steps to execute
    argument = " "
    argument = argument + "--make_simulation_folder 1 " + "--create_or_load_urban_canopy_object 1 " + "--save_urban_canopy_object_to_pickle 1 " + "--save_urban_canopy_object_to_json 1 " + "--run_ubes_with_openstudio 1 "
    # OPtionnal argument of the bat file/Python script
    if path_simulation_folder_ is not None:
        argument = argument + ' -f "{}"'.format(path_simulation_folder_)
    if building_id_list_ is not None and building_id_list_ != []:
        argument = argument + ' --building_id_list "{}"'.format(building_id_list_)
    if _path_weather_file is not None:
        argument = argument + ' --path_weather_file "{}"'.format(_path_weather_file)
    if path_ddy_file_ is not None:
        argument = argument + ' --ddy_file "{}"'.format(ddy_file_)
    if _hb_simulation_parameters is not None:
        argument = argument + ' --path_hbjson_simulation_parameters_file "{}"'.format(path_hbjson_simulation_parameter_file)
    if _cop_cooling_ is not None:
        argument = argument + " --cop_cooling {}".format(float(_cop_cooling_))
    if _cop_heating_ is not None:
        argument = argument + " --cop_heating {}".format(float(_cop_heating_))
    if _overwrite_ is not None:
        argument = argument + " --overwrite {}".format(int(_overwrite_))
    # if run_in_parallel_ is not None:
    #     argument = argument + " --run_in_parallel {}".format(int(run_in_parallel_))

    # Add the name of the component to the argument
    argument = argument + " -c {}".format(ghenv.Component.NickName)
    # Run the bat file
    output = os.system(command + argument)

# set default value for the simulation folder if not provided
if path_simulation_folder_ is None:
    path_simulation_folder_ = os.path.join(path_tool, "Simulation_temp")

# Read the log file
report = read_logs(path_simulation_folder_)
# ---------- end runubeswithopenstudio ----------
# UBES
falsestart_9 = LBFalseStartToggle(True)
falsestart_10 = LBFalseStartToggle(True)
readbesresults = BUAReadBESResults(path_simulation_folder=runubeswithopenstudio.path_simulation_folder, run=falsestart_9)  # -> report, read_building_id_list, end_uses_energy_label, end_uses_energy_consumption_tree; inputs building_id_list: list, run: Boolean
# ---------- readbesresults: Python ----------
"""Read the results of the Building Energy Simulation (BES) for the buildings individually.
    Inputs:
        path_simulation_folder_: Path to the simulationfolder. By default, the code will be run in
                                Appdata\Local\Building_urban_analysis\Simulation_temp
        building_id_list_: List of building ids to read. If empty, the result will be read for all target buildings.
        _run : Plug a boolean toggle to True to run the code and display the results.
    Output:
        read_building_id_list : List of the ids of the buildings that were read
        end_uses_energy_label : list of the eend energy use categories shown in the results
        end_uses_energy_consumption_tree : Tree of the list of the yearly energy consumption for each read building.
"""

__author__ = "Elie"
__version__ = "2024.04.07"

ghenv.Component.Name = "BUA Read BES Results"
ghenv.Component.NickName = 'ReadBESResults'
ghenv.Component.Category = 'BUA'
ghenv.Component.SubCategory = '5 :: Energy Simulation'

import json
import os

import ghpythonlib.treehelpers as th


def clean_path(path):
    path = path.replace("\\", "/")
    return (path)


def extract_sorted_bes_keys(dictionary):
    # Specific order of keys
    order = ["heating", "cooling", "lighting", "equipment", "ventilation", "total"]

    # Initialize a list to hold the keys in the desired order
    ordered_keys = []

    # Iterate through the specific order and add the keys if they exist in the dictionary
    for key in order:
        if key in dictionary:
            ordered_keys.append(key)

    # Add any additional keys that are not in the specific order
    for key in dictionary:
        if key not in ordered_keys:
            ordered_keys.append(key)

    return ordered_keys


# Get Appdata\local folder
local_appdata = os.environ['LOCALAPPDATA']
path_tool = os.path.join(local_appdata, "Building_urban_analysis")

# set default value for the simulation folder if not provided
if path_simulation_folder_ is None:
    path_simulation_folder_ = os.path.join(path_tool, "Simulation_temp")

path_json = os.path.join(path_simulation_folder_, "urban_canopy.json")

# Run the code if the _run input is set to True
if _run:
    # Check if the json file exists
    if not os.path.isfile(path_json):
        raise ValueError("The json file of the urban canopy does not exist, it means that the simulation was not run.")

    # Read the json file
    with open(path_json, 'r') as json_file:
        urban_canopy_dict = json.load(json_file)

    # Get the list of the building ids to display
    if building_id_list_ == [] or building_id_list_ is None:
        # add the id of the buildings that have been run if no list is provided
        building_id_list_ = [building_id for building_id in urban_canopy_dict["buildings"].keys() if
                             (urban_canopy_dict["buildings"][building_id]["type"] == "BuildingModeled" and
                              urban_canopy_dict["buildings"][building_id]["bes"]["has_run"])]

    else:  # Check if the building ids are in the json file
        for building_id in building_id_list_:
            try:
                urban_canopy_dict["buildings"][building_id]
            except KeyError:
                raise KeyError("Building with ID '{}' not found in the dictionary.".format(building_id))
            else:
                if not urban_canopy_dict["buildings"][building_id]["type"] == "BuildingModeled":
                    raise ValueError(
                        "Building with ID {} does not have a HB model, a BES cannot be performed on it".format(
                            building_id))
                elif not urban_canopy_dict["buildings"][building_id]["bes"]["has_run"]:
                    raise ValueError("BES for building ID {} was not performed".format(building_id))

    # Init
    end_uses_energy_consumption_tree = []
    read_building_id_list = building_id_list_

    # Collect the labels of the end uses
    end_uses_energy_label = extract_sorted_bes_keys(
        urban_canopy_dict["buildings"][building_id_list_[0]]["bes"]["bes_results_dict"])

    for building_id in building_id_list_:
        # Collect the energy consumption for each end use
        building_end_uses_energy_consumption = []
        for label in end_uses_energy_label:
            building_end_uses_energy_consumption.append(urban_canopy_dict["buildings"][building_id]["bes"][
                                                            "bes_results_dict"][label]["yearly"])
        end_uses_energy_consumption_tree.append([building_end_uses_energy_consumption])

    # Convert to tree
    end_uses_energy_consumption_tree = th.list_to_tree(end_uses_energy_consumption_tree)
# ---------- end readbesresults ----------
readubesresults = BUAReadUBESResults(path_simulation_folder=runubeswithopenstudio.path_simulation_folder, run=falsestart_10)  # -> report, end_uses_energy_label, end_uses_energy_consumption; inputs run: Boolean
# ---------- readubesresults: Python ----------
"""Read the results of the Urban Building Energy Simulation.
    Inputs:
        path_simulation_folder_: Path to the simulation folder. By default, the code will be run in
                                Appdata\Local\Building_urban_analysis\Simulation_temp
        _run : Plug a boolean toggle to True to run the code and display the results.
    Output:
        end_uses_energy_label : list of the eend energy use categories shown in the results
        end_uses_energy_consumption : List of the yearly energy consumption of the whole urban canopy.
"""

__author__ = "Elie"
__version__ = "2024.04.07"

ghenv.Component.Name = "BUA Read UBES Results"
ghenv.Component.NickName = 'ReadUBESResults'
ghenv.Component.Category = 'BUA'
ghenv.Component.SubCategory = '5 :: Energy Simulation'

import json
import os

def clean_path(path):
    path = path.replace("\\", "/")
    return (path)


def extract_sorted_bes_keys(dictionary):
    """Extract the keys of the dictionary in a specific order."""
    # Specific order of keys
    order = ["heating", "cooling", "lighting", "equipment", "ventilation", "total"]
    # Initialize a list to hold the keys in the desired order
    ordered_keys = []
    # Iterate through the specific order and add the keys if they exist in the dictionary
    for key in order:
        if key in dictionary:
            ordered_keys.append(key)
    # Add any additional keys that are not in the specific order
    for key in dictionary:
        if key not in ordered_keys:
            ordered_keys.append(key)

    return ordered_keys


# Get Appdata\local folder
local_appdata = os.environ['LOCALAPPDATA']
path_tool = os.path.join(local_appdata, "Building_urban_analysis")

# set default value for the simulation folder if not provided
if path_simulation_folder_ is None:
    path_simulation_folder_ = os.path.join(path_tool, "Simulation_temp")

path_json = os.path.join(path_simulation_folder_, "urban_canopy.json")

# Run the code if the _run input is set to True
if _run:
    # Check if the json file exists
    if not os.path.isfile(path_json):
        raise ValueError(
            "The json file of the urban canopy does not exist, it means that the simulation was not run.")

    # Read the json file
    with open(path_json, 'r') as json_file:
        urban_canopy_dict = json.load(json_file)

    # Check that the UBES was run
    if not urban_canopy_dict["ubes"]["has_run"]:
        raise ValueError("The UBES simulation was not run. Run the simulation first.")

    # Init
    end_uses_energy_consumption = []

    # Collect the labels of the end uses
    end_uses_energy_label = extract_sorted_bes_keys(
        urban_canopy_dict["ubes"]["ubes_results_dict"])

    for label in end_uses_energy_label:
        end_uses_energy_consumption.append(urban_canopy_dict["ubes"]["ubes_results_dict"][label]["yearly"])
# ---------- end readubesresults ----------
panel_5 = Panel(readubesresults.end_uses_energy_consumption)
bang_5 = ExplodeTree(Data=readbesresults.end_uses_energy_consumption_tree)  # -> Branch0, Branch1, Branch2
panel_6 = Panel(readbesresults.read_building_id_list)
panel_7 = Panel(readubesresults.end_uses_energy_label)
filter_6 = StreamFilter(Gate=Slider(0, range=0..2), Stream0=bang_5.Branch0, Stream1=bang_5.Branch1, Stream2=bang_5.Branch2)
panel_8 = Panel(filter_6)
panel_9 = Panel(readbesresults.end_uses_energy_label)

# ----
# Generate SensorGrid
button_4 = Button()
generatemeshforbipv = BUAGenerateMeshForBIPV(
    path_simulation_folder=filter,
    roof_bipv=Toggle(True),
    facades_bipv=Toggle(True),
    roof_grid_size_x="2.05",
    roof_grid_size_y="1.05",
    facades_grid_size_x="2.05",
    facades_grid_size_y="1.05",
    offset_dist="0.1",
    overwrite=Toggle(True),
    run=button_4)  # -> report, path_simulation_folder; inputs building_id_list: list, roof_bipv: Boolean, facades_bipv: Boolean, merge_building_faces: Boolean, run: Boolean
# ---------- generatemeshforbipv: Python ----------
"""Generate mesh on buildings for BIPV simulation.
    Inputs:
        path_simulation_folder_: Path to the simulation folder. Default = Appdata\Local\Building_urban_analysis\Simulation_temp
        building_id_list_: list of buildings we want to run the simulation on
        _roof_bipv: bool : True if we want to run the simulation on the roof
        _facades_bipv: bool : True if we want to run the simulation on the facades
        _roof_grid_size_x_: float : Size of the grid on the x axis on the roof.
                    Default = 1.5
        _roof_grid_size_y_: float : Size of the grid on the y axis on the roof.
                    Default = 1.5
        _facades_grid_size_x_: float : Size of the grid on the x axis on the facades.
                    Default = 1.5
        _facades_grid_size_y_: float : Size of the grid on the x axis on the facades.
                    Default = 1.5
        _offset_dist_: float:  Distance between the edges of surfaces and the mesh .
                    Typically, this should be a small positive number to ensure points are not blocked by the mesh.
                    Default = 0.1
        merge_building_faces_: Set to True if a on a geometry with merged faces should be generated to ignore
            the artificial subdivisions of floors and apartment when generating the mesh. To adjust the parameters
            of the merged faces, use the component "BUA Merge Building Faces" before generating the mesh.
            Default = False
        overwrite_: bool: True if the new mesh should overwrite the previous one if it exists.
        _run: Plug in a button to run the component
    Output:
        report: logs
        path_simulation_folder_: Path to the folder."""

__author__ = "elie-medioni"
__version__ = "2024.05.07"

ghenv.Component.Name = "BUA Generate Mesh For BIPV"
ghenv.Component.NickName = 'GenerateMeshForBIPV'
ghenv.Component.Category = 'BUA'
ghenv.Component.SubCategory = '6 :: Solar Radiation and BIPV'


import os

def clean_path(path):
    path = path.replace("\\", "/")
    return (path)

def read_logs(path_simulation_folder):
    path_log_file = os.path.join(path_simulation_folder_, "gh_components_logs",
                                 ghenv.Component.NickName + ".log")
    if os.path.isfile(path_log_file):
        with open(path_log_file, 'r') as log_file:
            log_data = log_file.read()
        return (log_data)
    else:
        return ("No log file found")

# Check path_simulation_folder_
if path_simulation_folder_ is not None and os.path.isdir(path_simulation_folder_) is False:
    raise ValueError("The simulation folder does not exist, enter a valid path")



# todo: make grid parameter and merge_building_faces_ components
# todo : check the values of the other parameters


# Get Appdata\local folder
local_appdata = os.environ['LOCALAPPDATA']
path_tool = os.path.join(local_appdata, "Building_urban_analysis")
path_bat_file = os.path.join(path_tool, "Scripts", "mains_tool", "run_BUA.bat")

if _run and (_roof_bipv or _facades_bipv):

    # Check _roof_bipv and _facades_bipv
    if (_roof_bipv is None or not _roof_bipv) and (_facades_bipv is None or not _facades_bipv):
        raise ValueError("Please select if you want to run the simulation on the roof and/or the facades")

    # Write the command
    command = path_bat_file
    # Steps to execute
    argument = " "
    argument = argument + "--make_simulation_folder 1 " + "--create_or_load_urban_canopy_object 1 " +  "--save_urban_canopy_object_to_pickle 1 " + "--save_urban_canopy_object_to_json 1 " + "--generate_sensorgrid 1 "
    # OPtionnal argument of the bat file/Python script
    if path_simulation_folder_ is not None:
        argument = argument + ' -f "{}"'.format(path_simulation_folder_)
    if building_id_list_ is not None and building_id_list_ != []:
        argument = argument + ' --building_id_list "{}"'.format(building_id_list_)
    if _roof_bipv:
        argument = argument + " --on_roof 1 "
    if _facades_bipv:
        argument = argument + " --on_facades 1 "
    if _roof_grid_size_x_ is not None:
        argument = argument + " --roof_grid_size_x {}".format(_roof_grid_size_x_)
    if _roof_grid_size_y_ is not None:
        argument = argument + " --roof_grid_size_y {}".format(_roof_grid_size_y_)
    if _facades_grid_size_x_ is not None:
        argument = argument + " --facades_grid_size_x {}".format(_facades_grid_size_x_)
    if _facades_grid_size_y_ is not None:
        argument = argument + " --facades_grid_size_y {}".format(_facades_grid_size_y_)
    if _offset_dist_ is not None:
        argument = argument + " --offset_dist {}".format(_offset_dist_)
    if merge_building_faces_ is not None:
        argument = argument + " --make_merged_faces_hb_model {}".format(int(merge_building_faces_))
    if overwrite_ is not None:
        argument = argument + " --overwrite {}".format(int(overwrite_))

    # Add the name of the component to the argument
    argument = argument + " -c {}".format(ghenv.Component.NickName)
    # Run the bat file
    output = os.system(command + argument)

# set default value for the simulation folder if not provided
if path_simulation_folder_ is None:
    path_simulation_folder_ = os.path.join(path_tool, "Simulation_temp")

# Read the log file
report = read_logs(path_simulation_folder_)
# ---------- end generatemeshforbipv ----------
falsestart_11 = LBFalseStartToggle(True)
plotbipvmesh = BUAPlotBIPVMesh(path_simulation_folder=generatemeshforbipv.path_simulation_folder, run=falsestart_11)  # -> report, building_id_list, path_simulation_folder, roof_hb_sensorgrid_tree, facades_hb_sensorgrid_tree; inputs building_id_list: list, run: Boolean
# ---------- plotbipvmesh: Python ----------
"""Plot the meshes on the buildings for the BIPV simulation
    Inputs:
        path_simulation_folder_: Path to the simulation folder. Default = Appdata\Local\Building_urban_analysis\Simulation_temp
        building_id_list_: list of buildings identifiers that need to be plotted.
        If no id is inputted, it will display the mesh of all the buildings that have one.
        _run: Plug in a boolean toggle to run the component
    Output:
        report: report
        path_simulation_folder_: Path to the folder.
        roof_hb_sensorgrid_tree: Tree of meshes for the roof
        facades_hb_sensorgrid_tree: Tree of meshes for the facades"""

__author__ = "elie-medioni"
__version__ = "2024.05.07"

ghenv.Component.Name = "BUA Plot BIPV Mesh"
ghenv.Component.NickName = 'PlotBIPVMesh'
ghenv.Component.Category = 'BUA'
ghenv.Component.SubCategory = '6 :: Solar Radiation and BIPV'

import ghpythonlib.treehelpers as th

import json
import os

from honeybee_radiance.sensorgrid import SensorGrid
from ladybug_rhino.fromgeometry import from_mesh3d

def clean_path(path):
    path = path.replace("\\", "/")
    return (path)


def get_rhino_mesh_from_sensor_grid(sensor_grid_dict):
    sensor_grid = SensorGrid.from_dict(sensor_grid_dict)
    mesh = sensor_grid.mesh
    mesh_rhino = from_mesh3d(mesh)
    return mesh_rhino


# Get Appdata\local folder
local_appdata = os.environ['LOCALAPPDATA']
path_tool = os.path.join(local_appdata, "Building_urban_analysis")

# Check path_simulation_folder_
if path_simulation_folder_ is None:
    path_simulation_folder_ = os.path.join(path_tool, "Simulation_temp")
elif os.path.isdir(path_simulation_folder_) is False:
    raise ValueError("The simulation folder does not exist, enter a valid path")

# Path to the urban canopy json file
path_json = os.path.join(path_simulation_folder_, "urban_canopy.json")

if _run:

    # Check if the urban canopy json file exists
    if not os.path.isfile(path_json):
        raise ValueError(
            "The urban canopy json file does not exist, buildings need to be loaded before running the context selection.")
    # Read the json file
    with open(path_json, 'r') as json_file:
        urban_canopy_dict = json.load(json_file)

    # Get the list of the building ids to display
    if building_id_list_ == [] or building_id_list_ is None:
        # add the id of the buildings that have been run if no list is provided
        building_id_list_ = [building_id for building_id in urban_canopy_dict["buildings"].keys() if
                             (urban_canopy_dict["buildings"][building_id]["type"] == "BuildingModeled" and
                              (urban_canopy_dict["buildings"][building_id]["solar_radiation_and_bipv"]["roof_sensorgrid"] is not None
                              or urban_canopy_dict["buildings"][building_id]["solar_radiation_and_bipv"]["facades_sensorgrid"] is not None))]

    else:  # Check if the building ids are in the json file
        for building_id in building_id_list_:
            try:
                urban_canopy_dict["buildings"][building_id]
            except KeyError:
                raise KeyError("Building with ID '{}' not found in the dictionary.".format(building_id))
            else:
                if not urban_canopy_dict["buildings"][building_id]["type"] == "BuildingModeled":
                    raise ValueError(
                        "Building with ID {} does not have a HB model, no mesh could have been performed on it".format(
                            building_id))
                elif (urban_canopy_dict["buildings"][building_id]["solar_radiation_and_bipv"]["roof_sensorgrid"] is None
                              and  urban_canopy_dict["buildings"][building_id]["solar_radiation_and_bipv"]["facades_sensorgrid"] is None):
                    raise ValueError("No mesh was generated for the building id {}".format(building_id))

    # Init
    mesh_roof_list = []
    mesh_facades_list = []

    for building_id in building_id_list_:
        # Roof
        if urban_canopy_dict["buildings"][building_id]["solar_radiation_and_bipv"]["roof_sensorgrid"] is not None:
            sensor_grid_dict_roof = urban_canopy_dict["buildings"][building_id]["solar_radiation_and_bipv"][
                "roof_sensorgrid"]
            mesh_roof_list.append(get_rhino_mesh_from_sensor_grid(sensor_grid_dict_roof))
        else:
            mesh_roof_list.append(None)
        # Facades
        if urban_canopy_dict["buildings"][building_id]["solar_radiation_and_bipv"]["facades_sensorgrid"] is not None:
                sensor_grid_dict_facades = urban_canopy_dict["buildings"][building_id]["solar_radiation_and_bipv"][
                    "facades_sensorgrid"]
                mesh_facades_list.append(get_rhino_mesh_from_sensor_grid(sensor_grid_dict_facades))
        else:
            mesh_facades_list.append(None)


    roof_hb_sensorgrid_tree = th.list_to_tree(mesh_roof_list)
    facades_hb_sensorgrid_tree = th.list_to_tree(mesh_facades_list)

if not os.path.isfile(path_json):
    print("the json file of the urban canopy does not exist")
# ---------- end plotbipvmesh ----------

mjoin = MeshJoin(Meshes=flatten(plotbipvmesh.roof_hb_sensorgrid_tree))
mjoin_2 = MeshJoin(Meshes=flatten(plotbipvmesh.facades_hb_sensorgrid_tree))
merge = Merge(Data1=mjoin, Data2=mjoin_2)

faceb = FaceBoundaries(Mesh=plotbipvmesh.roof_hb_sensorgrid_tree)
faceb_2 = FaceBoundaries(Mesh=plotbipvmesh.facades_hb_sensorgrid_tree)

mjoin_3 = MeshJoin(Meshes=flatten(merge))

# ----
# Compute Annual Solar Irradiance
path_epw_file = Data(getsampledataforexamplefile_3.path_sample_epw_file)
runannualsolarirradiance = BUARunAnnualSolarIrradiance(
    path_simulation_folder=generatemeshforbipv.path_simulation_folder,
    path_epw_weather_file=path_epw_file,
    overwrite=Toggle(True),
    run=Button())  # -> report, path_simulation_folder; inputs building_id_list: list, overwrite: Boolean, run: Boolean
# ---------- runannualsolarirradiance: Python ----------
"""Run the annual solar irradiance simulation on the mesh of the buildings.
    Inputs:
        path_simulation_folder_: Path to the simulation folder. Default = Appdata\Local\Building_urban_analysis\Simulation_temp
        building_id_list_: list of ints: list of buildings we want to run the simulation on. If None, all the target
         buildings will be simulated
        _path_epw_weather_file: Path to the weather file.
        _north_: A number between -360 and 360 for the counterclockwise
            difference between the North and the positive Y-axis in degrees.
            90 is West and 270 is East. (Default: 0)
        _overwrite_: Set to True if we want to rerun the simulation for buildings that were simulated before if some parameters were changed.
                Otherwise they will be skipped. (Default: False)
        _run: Plug in a button to run the component
    Output:
        report: report
        path_simulation_folder_: Path to the folder."""

__author__ = "elie-medioni"
__version__ = "2024.05.07"

ghenv.Component.Name = "BUA Run Annual Solar Irradiance"
ghenv.Component.NickName = 'RunAnnualSolarIrradiance'
ghenv.Component.Category = 'BUA'
ghenv.Component.SubCategory = '6 :: Solar Radiation and BIPV'

import os

def clean_path(path):
    path = path.replace("\\", "/")
    return (path)

def read_logs(path_simulation_folder):
    path_log_file = os.path.join(path_simulation_folder_, "gh_components_logs",
                                 ghenv.Component.NickName + ".log")
    if os.path.isfile(path_log_file):
        with open(path_log_file, 'r') as log_file:
            log_data = log_file.read()
        return (log_data)
    else:
        return ("No log file found")



# Get Appdata\local folder
local_appdata = os.environ['LOCALAPPDATA']
path_tool = os.path.join(local_appdata, "Building_urban_analysis")
path_bat_file = os.path.join(path_tool, "Scripts", "mains_tool", "run_BUA.bat")

# Check path_simulation_folder_
if path_simulation_folder_ is not None and os.path.isdir(path_simulation_folder_) is False:
    raise ValueError("The simulation folder does not exist, enter a valid path")

# Check the path to the weather file
if _path_epw_weather_file is not None and os.path.isfile(_path_epw_weather_file) is False:
    raise ValueError("The weather file does not exist, enter a valid path")

if _run :
    # Write the command
    command = path_bat_file
    # Steps to execute
    argument = " "
    argument = argument + "--make_simulation_folder 1 " + "--create_or_load_urban_canopy_object 1 " +  "--save_urban_canopy_object_to_pickle 1 " + "--save_urban_canopy_object_to_json 1 " + "--run_annual_solar_irradiance_simulation 1 "
    # OPtionnal argument of the bat file/Python script
    if path_simulation_folder_ is not None:
        argument = argument + ' -f "{}"'.format(path_simulation_folder_)
    if building_id_list_ is not None and building_id_list_ != []:
        argument = argument + ' --building_id_list "{}"'.format(building_id_list_)
    if _path_epw_weather_file is not None and os.path.isfile(_path_epw_weather_file):
        argument = argument + ' -w "{}"'.format(_path_epw_weather_file)
    if _north_ is not None:
        argument = argument + ' --north_angle "{}"'.format(_north_)
    if _overwrite_ is not None:
        argument = argument + ' --overwrite "{}"'.format(int(_overwrite_))
    # Add the name of the component to the argument
    argument = argument + ' -c "{}"'.format(ghenv.Component.NickName)
    # Run the bat file
    output = os.system(command + argument)

# set default value for the simulation folder if not provided
if path_simulation_folder_ is None:
    path_simulation_folder_ = os.path.join(path_tool, "Simulation_temp")

# Read the log file
report = read_logs(path_simulation_folder_)
# ---------- end runannualsolarirradiance ----------
falsestart_12 = LBFalseStartToggle(True)
falsestart_13 = LBFalseStartToggle(True)
readannualsolarirrandianceresults = BUAReadAnnualSolarIrrandianceResults(path_simulation_folder=runannualsolarirradiance.path_simulation_folder, kept_panel_only=falsestart_12, run=falsestart_13)  # -> report, building_id_list, roof_annual_irradiance_tree, facades_annual_irradiance_tree; inputs building_id_list: list, kept_panel_only: Boolean, run: Boolean
# ---------- readannualsolarirrandianceresults: Python ----------
"""Read the annual solar irradiance results from the json file of the urban canopy.
    Inputs:
        path_simulation_folder_: Path to the folder
        building_id_list_: list of ints: list of buildings we want to read the results
        kept_panel_only_ : Set to True if we want to read the results for the kept panels only.
            This option is only available after the bipv simulation.
        _run: Plug in a boolean toggle to run the component and read the results
    Output:
        report: report
        roof_annual_irradiance_tree: Tree of the annual irradiance for the roof
        facades_annual_irradiance_tree: Tree of the annual irradiance for the facades"""

__author__ = "elie-medioni"
__version__ = "2024.05.07"

ghenv.Component.Name = "BUA Read Annual Solar Irrandiance Results"
ghenv.Component.NickName = 'ReadAnnualSolarIrrandianceResults'
ghenv.Component.Category = 'BUA'
ghenv.Component.SubCategory = '6 :: Solar Radiation and BIPV'

import ghpythonlib.treehelpers as th

import json
import os


def clean_path(path):
    path = path.replace("\\", "/")
    return (path)


# Get Appdata\local folder
local_appdata = os.environ['LOCALAPPDATA']
path_tool = os.path.join(local_appdata, "Building_urban_analysis")

# Check path_simulation_folder_
if path_simulation_folder_ is None:
    path_simulation_folder_ = os.path.join(path_tool, "Simulation_temp")
elif os.path.isdir(path_simulation_folder_) is False:
    raise ValueError("The simulation folder does not exist, enter a valid path")

# Path to the urban canopy json file
path_json = os.path.join(path_simulation_folder_, "urban_canopy.json")

if kept_panel_only_ is None:
    kept_panel_only_ = False

path_json = os.path.join(path_simulation_folder_, "urban_canopy.json")

if _run:

    # Check if the urban canopy json file exists
    if not os.path.isfile(path_json):
        raise ValueError(
            "The urban canopy json file does not exist, buildings need to be loaded before running the context selection.")
    # Read the json file
    with open(path_json, 'r') as json_file:
        urban_canopy_dict = json.load(json_file)

    # Get the list of the building ids to display
    if building_id_list_ == [] or building_id_list_ is None:
        # add the id of the buildings that have been run if no list is provided
        building_id_list_ = [building_id for building_id in urban_canopy_dict["buildings"].keys() if
                             (urban_canopy_dict["buildings"][building_id]["type"] == "BuildingModeled" and
                              (urban_canopy_dict["buildings"][building_id]["solar_radiation_and_bipv"]["roof_annual_panel_irradiance_list"] is not None
                              or urban_canopy_dict["buildings"][building_id]["solar_radiation_and_bipv"]["facades_annual_panel_irradiance_list"] is not None))]

    else:  # Check if the building ids are in the json file
        for building_id in building_id_list_:
            try:
                urban_canopy_dict["buildings"][building_id]
            except KeyError:
                raise KeyError("Building with ID '{}' not found in the dictionary.".format(building_id))
            else:
                if not urban_canopy_dict["buildings"][building_id]["type"] == "BuildingModeled":
                    raise ValueError(
                        "Building with ID {} does not have a HB model, no radiation simulation could have been performed on it".format(
                            building_id))
                elif (urban_canopy_dict["buildings"][building_id]["solar_radiation_and_bipv"]["roof_annual_panel_irradiance_list"] is None
                              and  urban_canopy_dict["buildings"][building_id]["solar_radiation_and_bipv"]["facades_annual_panel_irradiance_list"] is None):
                    raise ValueError("Radiation simulation for building ID {} was not performed".format(building_id))

    # Init
    roof_annual_solar_irr_list = []
    facades_annual_solar_irr_list = []

    for building_id in building_id_list_:
        # Roof
        if urban_canopy_dict["buildings"][building_id]["solar_radiation_and_bipv"][
            "roof_annual_panel_irradiance_list"] is not None:
            annual_solar_irr = urban_canopy_dict["buildings"][building_id]["solar_radiation_and_bipv"][
                "roof_annual_panel_irradiance_list"]
            if kept_panel_only_ and urban_canopy_dict["buildings"][building_id]["solar_radiation_and_bipv"][
                "roof_panel_mesh_index_list"] is not None:
                annual_solar_irr = [
                    annual_solar_irr[i] if i in urban_canopy_dict["buildings"][building_id]["solar_radiation_and_bipv"][
                        "roof_panel_mesh_index_list"] else 0 for i, _ in enumerate(annual_solar_irr)]
            roof_annual_solar_irr_list.append(annual_solar_irr)
        else:
            roof_annual_solar_irr_list.append([])
        # Facade
        if urban_canopy_dict["buildings"][building_id]["solar_radiation_and_bipv"][
            "facades_annual_panel_irradiance_list"] is not None:
            annual_solar_irr = urban_canopy_dict["buildings"][building_id]["solar_radiation_and_bipv"][
                "facades_annual_panel_irradiance_list"]
            if kept_panel_only_ and urban_canopy_dict["buildings"][building_id]["solar_radiation_and_bipv"][
                "facades_panel_mesh_index_list"] is not None:
                annual_solar_irr = [
                    annual_solar_irr[i] if i in urban_canopy_dict["buildings"][building_id]["solar_radiation_and_bipv"][
                        "facades_panel_mesh_index_list"] else 0 for i, _ in enumerate(annual_solar_irr)]
            facades_annual_solar_irr_list.append(annual_solar_irr)
        else:
            facades_annual_solar_irr_list.append([])

    roof_annual_irradiance_tree = th.list_to_tree(roof_annual_solar_irr_list)
    facades_annual_irradiance_tree = th.list_to_tree(facades_annual_solar_irr_list)

if not os.path.isfile(path_json):
    print("the json file of the urban canopy does not exist")
# ---------- end readannualsolarirrandianceresults ----------
merge_2 = Merge(
    Data1=flatten(readannualsolarirrandianceresults.roof_annual_irradiance_tree),
    Data2=flatten(readannualsolarirrandianceresults.facades_annual_irradiance_tree))
data = Data(flatten(merge_2))

concat = Concatenate(FragmentB="Cumulative Radiation HB Radiance ", FragmentC=" [kWh/m2]")
concat_2 = Concatenate(FragmentA=Slider(13, range=0..100), FragmentB="%")
concat_3 = Concatenate(FragmentA=Slider(69, range=0..100), FragmentB="%")
concat_4 = Concatenate(FragmentA=Slider(7, range=0..100), FragmentB="%")
concat_5 = Concatenate(FragmentA=Slider(7, range=0..100), FragmentB="%")
legend2d = LBLegend2DParameters(origin_x=concat_2, origin_y=concat_3, seg_height=concat_4, seg_width=concat_5, text_height=Slider(20, range=0..100))  # -> leg_par2d; plug-in component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
series = Series(Start=0, Step=1, Count="20")

colors_gradient = GhPythonScript()  # -> out, gradient
# ---------- colors_gradient: Python ----------
import rhinoscriptsyntax as rs

from System.Drawing import Color

gradient=[
Color.FromArgb(0,0,0),
Color.FromArgb(0,0,100),
Color.FromArgb(0,0,150),
Color.FromArgb(0,0,255),
Color.FromArgb(150,0,202),
#Color.FromArgb(107,0,148),
#Color.FromArgb(160,0,95),
#Color.FromArgb(214,0,41),
Color.FromArgb(120,0,180),
Color.FromArgb(255,12,0),
#Color.FromArgb(255,66,0),
Color.FromArgb(255,80,0),
Color.FromArgb(255,119,0),
#Color.FromArgb(255,173,0),
#Color.FromArgb(255,226,0),
Color.FromArgb(255,255,0)]
# ---------- end colors_gradient ----------

# ----
# Plot Irradiance on SensorGrid
min = GhPythonScript(l=data)  # -> out, a; inputs l: list
# ---------- min: Python ----------
__author__ = "hilany"
__version__ = "2023.06.25"

import rhinoscriptsyntax as rs

a=min(l)
# ---------- end min ----------
max = GhPythonScript(l=data)  # -> out, a; inputs l: list
# ---------- max: Python ----------
__author__ = "hilany"
__version__ = "2023.06.25"

import rhinoscriptsyntax as rs

a=max(l)
# ---------- end max ----------
colors_gradient_2 = GhPythonScript()  # -> out, gradient
# ---------- colors_gradient_2: Python ----------
import rhinoscriptsyntax as rs

from System.Drawing import Color

gradient=[
Color.FromArgb(0,0,0),
Color.FromArgb(0,0,255),
Color.FromArgb(53,0,202),
Color.FromArgb(107,0,148),
Color.FromArgb(160,0,95),
Color.FromArgb(214,0,41),
Color.FromArgb(120,0,180),
#Color.FromArgb(255,12,0),
Color.FromArgb(255,66,0),
Color.FromArgb(255,80,0),
#Color.FromArgb(255,119,0),
#Color.FromArgb(255,173,0),
#Color.FromArgb(255,226,0),
Color.FromArgb(255,255,0)]
# ---------- end colors_gradient_2 ----------
legendpar = LBLegendParameters(
    min="0",
    max=max.a,
    colors=colors_gradient.gradient,
    num_decimals="0",
    vert_or_horiz=Toggle(False),
    seg_height=Slider(23.3, range=0.1..30))  # -> leg_par; plug-in component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
heatmap = LBSpatialHeatmap(values=data, mesh=mjoin_3, legend_par=legendpar)  # -> mesh, legend, title, colors, legend_par, vis_set; plug-in component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

createlegend = LBCreateLegend(values=series, title=concat, legend_par=legendpar, leg_par2d=legend2d)  # -> mesh, title_obj, label_objs, label_text, colors; plug-in component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
data_2 = Data(heatmap.mesh)

# ----
# BIPV Panel Simulation
bipvreplacementscenariooptions = BUABipvReplacementScenarios({"no replacement": "no_replacement", "replace failed panels every X years": "replace_failed_panels_every_X_years", "replace all panels every X years": "replace_all_panels_every_X_years", "replace failed panels at urban scale every X years": "uc_replace_failed_panels_every_X_years",, "replace all panels at urban scale every X year": "uc_replace_all_panels_every_X_years"}, selected="replace failed panels every X years")
bipvinvertertechnologyoptions = BUABipvInverterTechnologyOptions({"default inverter technology": "inverter_default"}, selected="default inverter technology")
bipvinvertertechnologyoptions_2 = BUABipvInverterTechnologyOptions({"default inverter technology": "inverter_default"}, selected="default inverter technology")
# BIPV
bipvpaneltechnologyoptions = BUABipvPanelTechnologyOptions({"Mitrex facade c-Si 350W": "mitrex_facades c-Si Solar Siding 350W - Dove Grey china default", "Mitrex roof c-Si 390W": "mitrex_roof c-Si M390-A1F default"}, selected="Mitrex roof c-Si 390W")
bipvpaneltechnologyoptions_2 = BUABipvPanelTechnologyOptions({"Mitrex facade c-Si 350W": "mitrex_facades c-Si Solar Siding 350W - Dove Grey china default", "Mitrex roof c-Si 390W": "mitrex_roof c-Si M390-A1F default"}, selected="Mitrex facade c-Si 350W")
bipvtransportoptions = BUABipvTransportOptions({"China-Israel"}, selected="China-Israel")
bipvtransportoptions_2 = BUABipvTransportOptions({"China-Israel"}, selected="China-Israel")
falsestart_14 = LBFalseStartToggle(True)
bipvreplacementscenarioparameter = BUABIPVReplacementScenarioParameter(replacement_scenario_id=bipvreplacementscenariooptions, replacement_frequency="35")  # -> out, replacement_scenario_parameters; inputs replacement_frequency: Int32, minimal_panel_age: Int32
# ---------- bipvreplacementscenarioparameter: Python ----------
"""Parameters for the BIPV replacement scenarios.
    Inputs:
        _replacement_scenario_id: Identifier of the bipv replacement scenario to use.
        _replacement_frequency_: Replacement frequency of the panels in years.
        _minimal_panel_age_: Minimum age of the panels to be replaced (to be implemented if relevant).
    Output:
        replacement_scenario_parameters_dict: Dictionary containing the parameters for the BIPV replacement scenarios"""

__author__ = "elie-medioni"
__version__ = "2023.09.06"

ghenv.Component.Name = "BUA BIPV Replacement Scenario Parameter"
ghenv.Component.NickName = 'BIPVReplacementScenarioParameter'
ghenv.Component.Message = '0.0.0'
ghenv.Component.Category = 'BUA'
ghenv.Component.SubCategory = '4 :: Solar Radiation and BIPV'
ghenv.Component.AdditionalHelpFromDocStrings = "1"

import json

# List of replacement without parameters
replacement_scenario_without_parameters_list = ["no_replacement"]
# List of the replacement scenarios that are implemented with replacement frequencies
replacement_scenario_implemented_with_replacement_frequencies_list = ["replace_failed_panels_every_X_years",
                                                                      "replace_all_panels_every_X_years",
                                                                      "uc_replace_failed_panels_every_X_years",
                                                                      "uc_replace_all_panels_every_X_years"]
# List of the replacement scenarios that are not implemented with replacement frequencies
replacement_scenario_not_implemented_with_replacement_frequencies_and_minimum_panel_age_list = [
    "replace_failed_panels_and_panels_above_X_years_every_Y_years",
    "uc_replace_failed_panels_and_panels_above_X_years_every_Y_years"]

# Initialize the replacement scenario parameter dictionary
replacement_scenario_parameters_dict = {
    "replacement_scenario_id": None,
    "replacement_frequency": None,
    "minimal_panel_age": None,
}

# Check if the parameters and combinations of parameters are valid
if _replacement_scenario_id is not None:
    if _replacement_scenario_id not in replacement_scenario_without_parameters_list + \
            replacement_scenario_implemented_with_replacement_frequencies_list + \
            replacement_scenario_not_implemented_with_replacement_frequencies_and_minimum_panel_age_list:
        raise ValueError(
            "The replacement scenario is not valid, use one of the values from the replacement scenarios list of values")
    elif _replacement_scenario_id in replacement_scenario_implemented_with_replacement_frequencies_list + replacement_scenario_not_implemented_with_replacement_frequencies_and_minimum_panel_age_list:
        if _replacement_frequency_ is None:
            raise ValueError("The replacement frequency is not defined")
        elif _replacement_frequency_ <= 0:
            raise ValueError("The replacement frequency cannot be negative")
        else:
            replacement_scenario_parameters_dict["replacement_scenario_id"] = _replacement_scenario_id
            replacement_scenario_parameters_dict["replacement_frequency"] = _replacement_frequency_
        if _replacement_scenario_id in replacement_scenario_not_implemented_with_replacement_frequencies_and_minimum_panel_age_list:
            if _minimal_panel_age_ is None:
                raise ValueError("The minimal panel age is not defined")
            elif _minimal_panel_age_ <= 0:
                raise ValueError("The minimal panel age cannot be negative")
            else:
                replacement_scenario_parameters_dict["minimal_panel_age"] = _minimal_panel_age_
    else: # if the replacement scenario is in the replacement_scenario_without_parameters_list
        replacement_scenario_parameters_dict["replacement_scenario_id"] = _replacement_scenario_id

replacement_scenario_parameters = json.dumps(replacement_scenario_parameters_dict)
# ---------- end bipvreplacementscenarioparameter ----------
bipvpanelsparameters = BUABIPVPanelsParameters(
    roof_pv_tech_id=bipvpaneltechnologyoptions,
    roof_pv_transport_id=bipvtransportoptions,
    roof_pv_inverter_id=bipvinvertertechnologyoptions,
    roof_inverter_sizing_ratio="0.9",
    facades_pv_tech_id=bipvpaneltechnologyoptions_2,
    facades_pv_transport_id=bipvtransportoptions_2,
    facades_pv_inverter_id=bipvinvertertechnologyoptions_2,
    facades_inverter_sizing_ratio="0.9",
    minimum_panel_eroi="1.5",
    run=falsestart_14)  # -> out, bipv_panel_parameters; inputs run: Boolean
# ---------- bipvpanelsparameters: Python ----------
"""Parameters for the BIPV panels.
    Inputs:
        _roof_pv_tech_id: Identifier of the PV technology to use for the roof
        _roof_pv_transport_id_: Identifier of the transport to use for the roof
        roof_pv_inverter_id_: Identifier of the inverter to use for the roof
        roof_inverter_sizing_ratio_: Roof inverter sizing ratio, ratio of the power of the inverter to the peak power of the panels. (Default: 0.9)
        _facades_pv_tech_id: Identifier of the PV technology to use for the facades
        _facades_pv_transport_id_: Identifier of the transport to use for the facades
        facades_pv_inverter_id_: Identifier of the inverter to use for the facades
        facades_inverter_sizing_ratio_: Facades inverter sizing ratio, ratio of the power of the inverter to the peak power of the panels. (Default: 0.9)
        _minimum_panel_eroi_: Minimum EROI of the PV panels to be installed (Default: 1.2)
        _run :Plug a boolean toggle to run the component and generate the output.
    Output:
        bipv_panel_parameters: Dictionary containing the parameters for the BIPV panels """

__author__ = "Elie"
__version__ = "2024.04.07"

ghenv.Component.Name = "BUA BIPV Panels Parameters"
ghenv.Component.NickName = 'BIPVPanelsParameters'
ghenv.Component.Category = 'BUA'
ghenv.Component.SubCategory = '6 :: Solar Radiation and BIPV'

import os
import json

# Get Appdata\local folder
local_appdata = os.environ['LOCALAPPDATA']
path_tool = os.path.join(local_appdata, "Building_urban_analysis")
path_data_libraries = os.path.join(path_tool, "Libraries")
path_bipv_library_folders = [os.path.join(path_data_libraries, "BIPV", "default"),
                             os.path.join(path_data_libraries, "BIPV", "user")]

# Initilize the bipv panel parameters dictionary

bipv_panel_parameters_dict = {
    "roof_pv_tech_id": None,
    "roof_pv_transport_id": None,
    "roof_pv_inverter_id": None,
    "roof_inverter_sizing_ratio": None,
    "facades_pv_tech_id": None,
    "facades_pv_transport_id": None,
    "facades_pv_inverter_id": None,
    "facades_inverter_sizing_ratio": None,
    "minimum_panel_eroi": None,
}

if _run:
    # Read the pv technologies dictionary to check if the parameters are valid
    pv_technologies_dict = {}
    for path_pv_technology_folder in path_bipv_library_folders:
        for json_file in os.listdir(path_pv_technology_folder):  # for every json file in the folder
            if json_file.endswith(".json"):
                path_json_file = os.path.join(path_pv_technology_folder,
                                              json_file)  # get the path to the json file
                with open(path_json_file) as f:  # open and load the json file
                    pv_dict_data = json.load(f)
                    for value in pv_dict_data.values():
                        if value["id"] not in pv_technologies_dict:
                            pv_technologies_dict[value["id"]] = value
                        else:
                            raise ValueError("The element " + value[
                                "id"] + " seems to be duplicated in the libraries. Please, check the libraries to make sure that the elements are unique")

    # Minimum panel eroi
    if _minimum_panel_eroi_ is not None and _minimum_panel_eroi_ < 1:
        raise ValueError(
            "The minimum panel eroi must be greater than 1, otherwise the panel is not profitable")
    else:
        bipv_panel_parameters_dict["minimum_panel_eroi"] = _minimum_panel_eroi_

    # Roof BIPV technology
    if _roof_pv_tech_id is not None:
        if _roof_pv_tech_id in pv_technologies_dict:
            if pv_technologies_dict[_roof_pv_tech_id]["type"] == "pv_technology":
                bipv_panel_parameters_dict["roof_pv_tech_id"] = _roof_pv_tech_id
            else:
                raise ValueError("_roof_pv_tech_id is not a pv technology, please choose a valid one")
        else:
            raise ValueError("The roof pv technology id is not valid")
    # Facade BIPV technology
    if _facades_pv_tech_id is not None:
        if _facades_pv_tech_id in pv_technologies_dict:
            if pv_technologies_dict[_facades_pv_tech_id]["type"] == "pv_technology":
                bipv_panel_parameters_dict["facades_pv_tech_id"] = _facades_pv_tech_id
            else:
                raise ValueError("_roof_pv_tech_id is not a pv technology, please choose a valid one")
        else:
            raise ValueError("The roof pv technology id is not valid")

    # Roof BIPV transport
    if _roof_pv_transport_id_ is not None:
        if _roof_pv_transport_id_ in pv_technologies_dict:
            if pv_technologies_dict[_roof_pv_transport_id_]["type"] == "transportation":
                bipv_panel_parameters_dict["roof_pv_transport_id"] = _roof_pv_transport_id_
            else:
                raise ValueError("_roof_pv_transport_id is not a transport, please choose a valid one")
        else:
            raise ValueError("The roof pv transport id is not valid")
    # Facade BIPV transport
    if _facades_pv_transport_id_ is not None:
        if _facades_pv_transport_id_ in pv_technologies_dict:
            if pv_technologies_dict[_facades_pv_transport_id_]["type"] == "transportation":
                bipv_panel_parameters_dict["facades_pv_transport_id"] = _facades_pv_transport_id_
            else:
                raise ValueError("_facades_pv_transport_id is not a transport, please choose a valid one")
        else:
            raise ValueError("The facades pv transport id is not valid")

    # Roof BIPV inverter
    if roof_pv_inverter_id_ is not None:
        if roof_pv_inverter_id_ in pv_technologies_dict:
            if pv_technologies_dict[roof_pv_inverter_id_]["type"] == "inverter":
                bipv_panel_parameters_dict["roof_pv_inverter_id"] = roof_pv_inverter_id_
            else:
                raise ValueError("_roof_pv_inverter_id is not an inverter, please choose a valid one")
        else:
            raise ValueError("The roof pv inverter id is not valid")
    # Facade BIPV inverter
    if facades_pv_inverter_id_ is not None:
        if facades_pv_inverter_id_ in pv_technologies_dict:
            if pv_technologies_dict[facades_pv_inverter_id_]["type"] == "inverter":
                bipv_panel_parameters_dict["facades_pv_inverter_id"] = facades_pv_inverter_id_
            else:
                raise ValueError("_facades_pv_inverter_id is not an inverter, please choose a valid one")
        else:
            raise ValueError("The facades pv inverter id is not valid")

    # Roof inverter sizing ratio
    if roof_inverter_sizing_ratio_ is not None:
        if roof_inverter_sizing_ratio_ <= 0:
            raise ValueError("The inverter sizing ratio must be greater than 0")
        else:
            bipv_panel_parameters_dict["roof_inverter_sizing_ratio"] = roof_inverter_sizing_ratio_
    # Facade inverter sizing ratio
    if facades_inverter_sizing_ratio_ is not None:
        if facades_inverter_sizing_ratio_ <= 0:
            raise ValueError("The inverter sizing ratio must be greater than 0")
        else:
            bipv_panel_parameters_dict["facades_inverter_sizing_ratio"] = facades_inverter_sizing_ratio_

bipv_panel_parameters = json.dumps(bipv_panel_parameters_dict)
# ---------- end bipvpanelsparameters ----------
bipv_simulation_identifier = Panel("bipv_simulation_1")
runbipvsimulation = BUARunBIPVSimulation(
    path_simulation_folder=runannualsolarirradiance.path_simulation_folder,
    bipv_simulation_identifier=bipv_simulation_identifier,
    bipv_panels_parameters=bipvpanelsparameters.bipv_panel_parameters,
    replacement_scenario_parameters=bipvreplacementscenarioparameter.replacement_scenario_parameters,
    start_year="2024",
    end_year="2074",
    overwrite=Toggle(True),
    update_panel_technology=Toggle(False),
    run=Button())  # -> report, path_simulation_folder; inputs building_id_list: list, start_year: Int32, end_year: Int32, update_panel_technology: Boolean, run: Boolean
# ---------- runbipvsimulation: Python ----------
"""Run the BIPV simulation for the selected buildings.
    Inputs:
        path_simulation_folder_: Path to the simulation folder.
            (Default = user\appdata\Local\Building_urban_analysis\Simulation_temp)
        building_id_list_: list of the identifier of the buildings that should be simulated. The buildings
            need to be target buildings to be simulated (Default = "all")
        _bipv_simulation_identifier_: Identifier of the simulation that should be simulated. The results of each
            simulation saved in a separate folder. (Default = "new_uc_scenario")
        _bipv_panels_parameters : Parameters of the BIPV simulation. to be defined from the BIPVParameters component.
        _replacement_scenario_parameters: Parameters of the replacement scenario. to be defined from the
            ReplacementScenarioParameters component.
        _start_year: Year from which the simulation should start. (Default: current year)
        _end_year: Year from which the simulation should end. For instance, if the start year is 2023 and the end year
         2026, the simulation will be run for 3 years: 2023,2024 and 2025 (Default: current year+50)
        _overwrite_: bool: True if the existing simulation should be overwritten. (Default: True)
        update_panel_technology_: Set to True if the panel technology should be updated to the inputted one when replaced.
        _run: Plug in a button to run the component
    Output:
        report: report
        path_simulation_folder_: Path to the folder."""

__author__ = "Elie"
__version__ = "2024.04.07"

ghenv.Component.Name = "BUA Run BIPV Simulation"
ghenv.Component.NickName = 'RunBIPVSimulation'
ghenv.Component.Category = 'BUA'
ghenv.Component.SubCategory = '6 :: Solar Radiation and BIPV'

import os
import json


def clean_path(path):
    path = path.replace("\\", "/")
    return (path)


def read_logs(path_simulation_folder):
    path_log_file = os.path.join(path_simulation_folder_, "gh_components_logs",
                                 ghenv.Component.NickName + ".log")
    if os.path.isfile(path_log_file):
        with open(path_log_file, 'r') as log_file:
            log_data = log_file.read()
        return (log_data)
    else:
        return ("No log found")


# Get Appdata\local folder
local_appdata = os.environ['LOCALAPPDATA']
path_tool = os.path.join(local_appdata, "Building_urban_analysis")
path_bat_file = os.path.join(path_tool, "Scripts", "mains_tool", "run_BUA.bat")

# Check path_simulation_folder_
if path_simulation_folder_ is not None and os.path.isdir(path_simulation_folder_) is False:
    raise ValueError("The simulation folder does not exist, enter a valid path")

# Check _bipv_panels_parameters
if _bipv_panels_parameters is not None:
    try:  # try to load the json
        bipv_panel_parameters_dict = json.loads(_bipv_panels_parameters)
    except:
        raise ValueError("The BIPV parameters are not valid, use the BIPV Parameters component as input")
    if (isinstance(bipv_panel_parameters_dict, dict) is False
            or "roof_pv_tech_id" not in bipv_panel_parameters_dict.keys()
            or "facades_pv_tech_id" not in bipv_panel_parameters_dict.keys()
            or "roof_pv_transport_id" not in bipv_panel_parameters_dict.keys()
            or "facades_pv_transport_id" not in bipv_panel_parameters_dict.keys()
            or "roof_pv_inverter_id" not in bipv_panel_parameters_dict.keys()
            or "facades_pv_inverter_id" not in bipv_panel_parameters_dict.keys()
            or "roof_inverter_sizing_ratio" not in bipv_panel_parameters_dict.keys()
            or "facades_inverter_sizing_ratio" not in bipv_panel_parameters_dict.keys()
            or "minimum_panel_eroi" not in bipv_panel_parameters_dict.keys()):

        raise ValueError("The BIPV parameters are not valid, use the BIPV Parameters component as input")
    else:
        roof_pv_tech_id = bipv_panel_parameters_dict["roof_pv_tech_id"]
        facades_pv_tech_id = bipv_panel_parameters_dict["facades_pv_tech_id"]
        roof_pv_transport_id = bipv_panel_parameters_dict["roof_pv_transport_id"]
        facades_pv_transport_id = bipv_panel_parameters_dict["facades_pv_transport_id"]
        roof_pv_inverter_id = bipv_panel_parameters_dict["roof_pv_inverter_id"]
        facades_pv_inverter_id = bipv_panel_parameters_dict["facades_pv_inverter_id"]
        roof_inverter_sizing_ratio = bipv_panel_parameters_dict["roof_inverter_sizing_ratio"]
        facades_inverter_sizing_ratio = bipv_panel_parameters_dict["facades_inverter_sizing_ratio"]
        minimum_panel_eroi = bipv_panel_parameters_dict["minimum_panel_eroi"]
else:
    roof_pv_tech_id = None
    facades_pv_tech_id = None
    roof_pv_transport_id = None
    facades_pv_transport_id = None
    roof_pv_inverter_id = None
    facades_pv_inverter_id = None
    roof_inverter_sizing_ratio = None
    facades_inverter_sizing_ratio = None
    minimum_panel_eroi = None

# Check _replacement_scenario_parameters
if _replacement_scenario_parameters is not None:
    try:  # try to load the json
        replacement_scenario_parameters_dict = json.loads(_replacement_scenario_parameters)
    except:
        raise ValueError("The BIPV parameters are not valid, use the BIPV Parameters component as input")
    if isinstance(replacement_scenario_parameters_dict,
                  dict) is False or "replacement_scenario_id" not in replacement_scenario_parameters_dict.keys() or "replacement_frequency" not in replacement_scenario_parameters_dict.keys() or "minimal_panel_age" not in replacement_scenario_parameters_dict.keys():
        raise ValueError(
            "The replacement scenario parameters are not valid, use the Replacement Scenario Parameters component as input")
    else:
        replacement_scenario_id = replacement_scenario_parameters_dict["replacement_scenario_id"]
        replacement_frequency = replacement_scenario_parameters_dict["replacement_frequency"]
        minimal_panel_age = replacement_scenario_parameters_dict["minimal_panel_age"]
else:
    replacement_scenario_id = None
    replacement_frequency = None
    minimal_panel_age = None

# Set _overwrite_ to True if it is not provided
if _overwrite_ is None:
    _overwrite_ = True

# Check _start_year and _end_year
if _start_year is None and _end_year is None:
    pass
elif _start_year is None:
    raise ValueError("The start year and the end year must be defined")
elif _start_year is not None and _end_year is not None and _start_year >= _end_year:
    raise ValueError("The start year must be lower than the end year")

if _run:
    # Write the command
    command = path_bat_file
    # Steps to execute
    argument = " "
    argument = argument + "--make_simulation_folder 1 " + "--create_or_load_urban_canopy_object 1 " + "--run_bipv_harvesting_and_lca_simulation 1 " + " --overwrite 1 " + "--save_urban_canopy_object_to_pickle 1 " + "--save_urban_canopy_object_to_json 1 "
    # OPtionnal argument of the bat file/Python script
    if path_simulation_folder_ is not None:
        argument = argument + ' -f "{}"'.format(path_simulation_folder_)
    if building_id_list_ is not None and building_id_list_ != []:
        argument = argument + ' --building_id_list "{}"'.format(building_id_list_)
    if _bipv_simulation_identifier_ is not None:
        argument = argument + ' --bipv_scenario_identifier "{}"'.format(_bipv_simulation_identifier_)
    if roof_pv_tech_id is not None:
        argument = argument + ' --id_pv_tech_roof "{}"'.format(roof_pv_tech_id)
    if facades_pv_tech_id is not None:
        argument = argument + ' --id_pv_tech_facades "{}"'.format(facades_pv_tech_id)
    if roof_pv_transport_id is not None:
        argument = argument + ' --roof_transport_id "{}"'.format(roof_pv_transport_id)
    if facades_pv_transport_id is not None:
        argument = argument + ' --facades_transport_id "{}"'.format(facades_pv_transport_id)
    if roof_pv_inverter_id is not None:
        argument = argument + ' --roof_inverter_id "{}"'.format(roof_pv_inverter_id)
    if facades_pv_inverter_id is not None:
        argument = argument + ' --facades_inverter_id "{}"'.format(facades_pv_inverter_id)
    if roof_inverter_sizing_ratio is not None:
        argument = argument + " --roof_inverter_sizing_ratio {}".format(roof_inverter_sizing_ratio)
    if facades_inverter_sizing_ratio is not None:
        argument = argument + " --facades_inverter_sizing_ratio {}".format(facades_inverter_sizing_ratio)
    if minimum_panel_eroi is not None:
        argument = argument + " --minimum_panel_eroi {}".format(minimum_panel_eroi)
    if replacement_scenario_id is not None:
        argument = argument + ' --replacement_scenario "{}"'.format(replacement_scenario_id)
    if replacement_frequency is not None:
        argument = argument + " --replacement_frequency {}".format(replacement_frequency)
    if minimal_panel_age is not None:
        argument = argument + " --minimal_panel_age {}".format(minimal_panel_age)
    if _start_year is not None:
        argument = argument + " --start_year {}".format(_start_year)
    if _end_year is not None:
        argument = argument + " --end_year {}".format(_end_year)
    if _overwrite_ is not None:
        argument = argument + " --overwrite {}".format(int(_overwrite_))
    if update_panel_technology_ is not None:
        argument = argument + " --update_panel_technology {}".format(int(update_panel_technology_))

    # Add the name of the component to the argument
    argument = argument + " -c {}".format(ghenv.Component.NickName)
    # Run the bat file
    output = os.system(command + argument)

# set default value for the simulation folder if not provided
if path_simulation_folder_ is None:
    path_simulation_folder_ = os.path.join(path_tool, "Simulation_temp")

# Path to the results of the simulation
name_radiation_simulation_folder = 'Irradiance and BIPV Simulation'
path_bipv_simulation_results_folder = os.path.join(path_simulation_folder_, name_radiation_simulation_folder)

# Check if the simulation folder exists
if os.path.isdir(path_bipv_simulation_results_folder):
    pass
else:
    path_bipv_simulation_results_folder = None

# Read the log file
report = read_logs(path_simulation_folder_)
# ---------- end runbipvsimulation ----------

# ----
# KPI computation and visualization
grid_ghg_intensity_israel = Panel("660")
grid_energy_intensity_israel = Panel("2.84")
gid_energy_intensity_israel = Panel("0.14")
electricitygridparameters = BUAElectricityGridParameters(
    grid_ghg_intensity=grid_ghg_intensity_israel,
    grid_energy_intensity=grid_energy_intensity_israel,
    grid_electricity_sell_price=gid_energy_intensity_israel)  # -> report, electricity_grid_parameters
# ---------- electricitygridparameters: Python ----------
"""Parameters of the Electricity Grid for the KPIs computation.
    Inputs:
        _grid_ghg_intensity: Green house gaz intensity of the electricity grid in kgCO2/kWh.
        _grid_energy_intensity: Energy intensity of the electricity grid in kWh/kWh.
        _grid_electricity_sell_price: Sell price of the electricity in $/kWh.
    Output:
        electricity_grid_parameters: Dictionary containing the electricity grid parameters"""

__author__ = "elie-medioni"
__version__ = "2024.03.31"

ghenv.Component.Name = "BUA Electricity Grid Parameters"
ghenv.Component.NickName = 'ElectricityGridParameters'
ghenv.Component.Category = 'BUA'
ghenv.Component.SubCategory = '6 :: Solar Radiation and BIPV'

import json

# Initialize the replacement scenario parameter dictionary
electricity_grid_parameters_dict = {
    "grid_ghg_intensity": None,
    "grid_energy_intensity": None,
    "grid_electricity_sell_price": None
}

# Check the _grid_ghg_intensity
if _grid_ghg_intensity is not None:
    if _grid_ghg_intensity <= 0:
        raise ValueError("The Green House Gaz intensity of the electricity grid must be a positive number.")
    else:
        electricity_grid_parameters_dict["grid_ghg_intensity"] = _grid_ghg_intensity
# Check the _grid_energy_intensity
if _grid_energy_intensity is not None:
    if _grid_energy_intensity <= 0:
        raise ValueError("The energy intensity of the electricity grid must be a positive number.")
    else:
        electricity_grid_parameters_dict["grid_energy_intensity"] = _grid_energy_intensity
# Check the _grid_electricity_sell_price
if _grid_electricity_sell_price is not None:
    if _grid_electricity_sell_price <= 0:
        raise ValueError("The sell price of the electricity must be a positive number.")
    else:
        electricity_grid_parameters_dict["grid_electricity_sell_price"] = _grid_electricity_sell_price

electricity_grid_parameters = json.dumps(electricity_grid_parameters_dict)
# ---------- end electricitygridparameters ----------
computekpis = BUAComputeKPIs(
    path_simulation_folder=runbipvsimulation.path_simulation_folder,
    bipv_simulation_identifier=bipv_simulation_identifier,
    electricity_grid_parameters=electricitygridparameters.electricity_grid_parameters,
    run=Button())  # -> report, path_simulation_folder; inputs run: Boolean
# ---------- computekpis: Python ----------
""" Compute the KPIs of the urban canopy scenario based on the results of the UBES and BIPV simulations.
    Inputs:
        path_simulation_folder_: Path to the simulation folder. Default = Appdata\Local\Building_urban_analysis\Simulation_temp
        _bipv_simulation_identifier_: Identifier of the simulation that should be simulated. The results of each
            simulation saved in a separate folder. (Default = "new_uc_scenario")
        _electricity_grid_parameters : Parameters of the electricity grid. to be defined from the ElectricityGridParameters component.
        zone_area_: Area in m2 of the terrain the urban canopy/group of buildings is built on, to compute the KPIs per
            m2 of land use. (Optional)
        _run: Plug in a button to run the component
    Output:
        report: logs
        path_simulation_folder_: Path to the folder.
        """

__author__ = "elie-medioni"
__version__ = "2024.04.01"

ghenv.Component.Name = "BUA Compute KPIs"
ghenv.Component.NickName = 'ComputeKPIs'
ghenv.Component.Category = 'BUA'
ghenv.Component.SubCategory = '6 :: Solar Radiation and BIPV'

import os
import json


def clean_path(path):
    path = path.replace("\\", "/")
    return (path)


def read_logs(path_simulation_folder):
    path_log_file = os.path.join(path_simulation_folder_, "gh_components_logs",
                                 ghenv.Component.NickName + ".log")
    if os.path.isfile(path_log_file):
        with open(path_log_file, 'r') as log_file:
            log_data = log_file.read()
        return (log_data)
    else:
        return ("No log file found")


# Get Appdata\local folder
local_appdata = os.environ['LOCALAPPDATA']
path_tool = os.path.join(local_appdata, "Building_urban_analysis")
path_bat_file = os.path.join(path_tool, "Scripts", "mains_tool", "run_BUA.bat")


# Check path_simulation_folder_
if path_simulation_folder_ is None:
    path_simulation_folder_ = os.path.join(path_tool, "Simulation_temp")
elif os.path.isdir(path_simulation_folder_) is False:
    raise ValueError("The simulation folder does not exist, enter a valid path")

# Path to the urban canopy json file
path_json = os.path.join(path_simulation_folder_, "urban_canopy.json")

# Check electricity grid parameters
if _electricity_grid_parameters is not None:
    try:  # try to load the json
        electricity_grid_parameters_dict = json.loads(_electricity_grid_parameters)
    except:
        raise ValueError(
            "The _electricity_grid_parameters input is not correct, use the Electricity Grid parameters component as input")
    if isinstance(electricity_grid_parameters_dict,
                  dict) is False or "grid_ghg_intensity" not in electricity_grid_parameters_dict.keys() or "grid_energy_intensity" not in electricity_grid_parameters_dict.keys() or "grid_electricity_sell_price" not in electricity_grid_parameters_dict.keys():
        raise ValueError(
            "The _electricity_grid_parameters input is not correct, use the Electricity Grid parameters component as input")
    else:
        grid_ghg_intensity = electricity_grid_parameters_dict["grid_ghg_intensity"]
        grid_energy_intensity = electricity_grid_parameters_dict["grid_energy_intensity"]
        grid_electricity_sell_price = electricity_grid_parameters_dict["grid_electricity_sell_price"]
else:
    grid_ghg_intensity = None
    grid_energy_intensity = None
    grid_electricity_sell_price = None

# Check the _bipv_simulation_identifier_
if _bipv_simulation_identifier_ is not None:
    # set default value for the simulation folder if not provided
    if path_simulation_folder_ is None:
        path_simulation_folder = os.path.join(path_tool, "Simulation_temp")
    else:
        path_simulation_folder = path_simulation_folder_
    # Path to the urban canopy json file
    path_uc_json = os.path.join(path_simulation_folder, "urban_canopy.json")
    if os.path.isfile(path_uc_json):
        with open(path_uc_json, 'r') as json_file:
            urban_canopy_dict = json.load(json_file)
        if _bipv_simulation_identifier_ not in urban_canopy_dict["bipv_scenarios"].keys():
            raise ValueError(
                "The simulation identifier is not valid, please check the identifier of the bipv simulation"
                "that were run with the adequate component")
    else:
        raise ValueError("The urban canopy json file does not exist, run the previous steps need to be run first")

# Check the zone_area_
if zone_area_ is not None:
    if zone_area_ <= 0:
        raise ValueError("The zone area must be greater than 0")

# Check if the _bipv_simulation_identifier_ is exist in the urban canopy json file if not None
if _bipv_simulation_identifier_ is not None:
    if not os.path.isfile(path_json):
        raise ValueError("The urban canopy json file does not exist, buildings need to be loaded before running the context selection.")
    with open(path_uc_json, 'r') as json_file:
        urban_canopy_dict = json.load(json_file)
    if _bipv_simulation_identifier_ not in urban_canopy_dict["bipv_scenarios"].keys():
        raise ValueError(
            "The simulation identifier is not valid, please check the identifier of the bipv simulation"
            "that were run with the adequate component")

if _run:
    # Write the command
    command = path_bat_file
    # Steps to execute
    argument = " "
    argument = argument + "--make_simulation_folder 1 " + "--create_or_load_urban_canopy_object 1 " + "--save_urban_canopy_object_to_pickle 1 " + "--save_urban_canopy_object_to_json 1 " + "--run_kpi_simulation 1 "
    # OPtionnal argument of the bat file/Python script
    if path_simulation_folder_ is not None:
        argument = argument + ' -f "{}"'.format(path_simulation_folder_)
    if _bipv_simulation_identifier_ is not None:
        argument = argument + ' --bipv_scenario_identifier "{}"'.format(_bipv_simulation_identifier_)
    if grid_ghg_intensity is not None:
        argument = argument + ' --grid_ghg_intensity "{}"'.format(grid_ghg_intensity)
    if grid_energy_intensity is not None:
        argument = argument + ' --grid_energy_intensity "{}"'.format(grid_energy_intensity)
    if grid_electricity_sell_price is not None:
        argument = argument + ' --grid_electricity_sell_price "{}"'.format(grid_electricity_sell_price)
    if zone_area_ is not None:
        argument = argument + ' --zone_area "{}"'.format(zone_area_)
    # Add the name of the component to the argument
    argument = argument + " -c {}".format(ghenv.Component.NickName)
    # Run the bat file
    output = os.system(command + argument)

# set default value for the simulation folder if not provided
if path_simulation_folder_ is None:
    path_simulation_folder_ = os.path.join(path_tool, "Simulation_temp")

# Read the log file
report = read_logs(path_simulation_folder_)
# ---------- end computekpis ----------
falsestart_15 = LBFalseStartToggle(True)
readukpisresults = BUAReadKpisResults(
    path_simulation_folder=computekpis.path_simulation_folder,
    bipv_simulation_identifier=bipv_simulation_identifier,
    run=falsestart_15)  # -> kpis_labels, kpis_bipv_roof, kpis_bipv_facades, kpis_bipv_total; inputs run: Boolean
# ---------- readukpisresults: Python ----------
"""Read the results of the KPI Simulation.
    Inputs:
        path_simulation_folder_: Path to the folder. By default, the code will be run in
                                Appdata\Local\Building_urban_analysis\Simulation_temp
        _bipv_simulation_identifier_: Identifier of the BIPV simulation. If not provided, the code will read
            the results of the last simulation.
        _run : Plug a boolean toggle to True to run the code and display the results.
    Output:
        kpis_label : list of the eend energy use categories shown in the results
        kpis_bipv_roof : list of the kpis for the roof BIPV.
        kpis_bipv_facades : list of the kpis for the facades BIPV.
        kpis_bipv_total : list of the kpis for the total BIPV.
"""

__author__ = "Elie"
__version__ = "2024.04.07"

ghenv.Component.Name = "BUA Read Kpis Results"
ghenv.Component.NickName = 'ReadUKPIsResults'
ghenv.Component.Category = 'BUA'
ghenv.Component.SubCategory = '6 :: Solar Radiation and BIPV'

import json
import os


def clean_path(path):
    path = path.replace("\\", "/")
    return (path)


labels = ["eroi", "primary energy payback time [year]", "ghg emissions intensity [kgCo2eq/kWh]",
          "ghg emissions payback time [year]", "net energy compensation", "net economical benefit [$]",
          "economical payback time [year]"]

# Get Appdata\local folder
local_appdata = os.environ['LOCALAPPDATA']
path_tool = os.path.join(local_appdata, "Building_urban_analysis")
path_bat_file = os.path.join(path_tool, "Scripts", "mains_tool", "run_BUA.bat")


# Check path_simulation_folder_
if path_simulation_folder_ is None:
    path_simulation_folder_ = os.path.join(path_tool, "Simulation_temp")
elif os.path.isdir(path_simulation_folder_) is False:
    raise ValueError("The simulation folder does not exist, enter a valid path")

# Path to the urban canopy json file
path_json = os.path.join(path_simulation_folder_, "urban_canopy.json")

# Check if the _bipv_simulation_identifier_ is exist in the urban canopy json file if not None
if _bipv_simulation_identifier_ is not None:
    if not os.path.isfile(path_json):
        raise ValueError("The urban canopy json file does not exist, buildings need to be loaded before running the context selection.")
    with open(path_json, 'r') as json_file:
        urban_canopy_dict = json.load(json_file)
    if _bipv_simulation_identifier_ not in urban_canopy_dict["bipv_scenarios"].keys():
        raise ValueError(
            "The simulation identifier is not valid, please check the identifier of the bipv simulation"
            "that were run with the adequate component")

# Run the code if the _run input is set to True
if _run:
    # Check if the json file exists
    if not os.path.isfile(path_json):
        raise ValueError(
            "The json file of the urban canopy does not exist, it means that the simulation was not run.")

    # Read the json file
    with open(path_json, 'r') as json_file:
        urban_canopy_dict = json.load(json_file)

    # check if the BIPV simulation identifier is valid
    if urban_canopy_dict["bipv_scenarios"] == {}:
        raise ValueError("No BIPV simulation was run. Run a BIPV simulation first.")
    elif _bipv_simulation_identifier_ is not None:
        if _bipv_simulation_identifier_ not in urban_canopy_dict["bipv_scenarios"]:
            raise ValueError("The BIPV simulation identifier is not valid.")
    else:
        if "new_uc_scenario" in urban_canopy_dict["bipv_scenarios"].keys():
            _bipv_simulation_identifier_ = "new_uc_scenario"
        else:
            raise ValueError("Please provide a BIPV simulation identifier if you did not use the default one.")

    print(urban_canopy_dict["bipv_scenarios"][_bipv_simulation_identifier_]["kpis_results_dict"])
    # Check that the UBES was run
    if not urban_canopy_dict["bipv_scenarios"][_bipv_simulation_identifier_]["kpis_results_dict"]["has_run"]:
        raise ValueError("The KPI computation was not run. Run the simulation first.")

    result_dict = urban_canopy_dict["bipv_scenarios"][_bipv_simulation_identifier_]["kpis_results_dict"]["kpis"]
    # Init
    end_uses_energy_consumption = []

    # Get results
    kpis_labels = labels
    kpis_bipv_roof = []
    kpis_bipv_facades = []
    kpis_bipv_total = []

    for label in kpis_labels:
        kpis_bipv_roof.append(result_dict[label]["roof"])
        kpis_bipv_facades.append(result_dict[label]["facades"])
        kpis_bipv_total.append(result_dict[label]["total"])

    # Take care of KPIs with densities
    labels.append("zone harvested energy density [Kwh/m2]")
    kpis_bipv_roof.append(result_dict["harvested energy density [Kwh/m2]"]["zone"]["roof"])
    kpis_bipv_facades.append(result_dict["harvested energy density [Kwh/m2]"]["zone"]["facades"])
    kpis_bipv_total.append(result_dict["harvested energy density [Kwh/m2]"]["zone"]["total"])
    labels.append("conditioned apartment harvested energy density [Kwh/m2]")
    kpis_bipv_roof.append(result_dict["harvested energy density [Kwh/m2]"]["conditioned_apartment"]["roof"])
    kpis_bipv_facades.append(result_dict["harvested energy density [Kwh/m2]"]["conditioned_apartment"][
            "facades"])
    kpis_bipv_total.append(result_dict["harvested energy density [Kwh/m2]"]["conditioned_apartment"]["total"])
    labels.append("zone net economical benefit density [$/m2]]")
    kpis_bipv_roof.append(result_dict["net economical benefit density [$/m2]"]["zone"]["roof"])
    kpis_bipv_facades.append(result_dict["net economical benefit density [$/m2]"]["zone"]["facades"])
    kpis_bipv_total.append(result_dict["net economical benefit density [$/m2]"]["zone"]["total"])
    labels.append("conditioned apartment net economical benefit density [$/m2]")
    kpis_bipv_roof.append(result_dict["net economical benefit density [$/m2]"]["conditioned_apartment"][
                              "roof"])
    kpis_bipv_facades.append(result_dict["net economical benefit density [$/m2]"]["conditioned_apartment"][
                                 "facades"])
    kpis_bipv_total.append(result_dict["net economical benefit density [$/m2]"]["conditioned_apartment"][
                               "total"])
# ---------- end readukpisresults ----------
labels = Panel(readukpisresults.kpis_labels)
kpis_roof = Panel(readukpisresults.kpis_bipv_roof)
kpis_facades = Panel(readukpisresults.kpis_bipv_facades)
kpis_total = Panel(readukpisresults.kpis_bipv_total)
