# Grasshopper definition visualize_hbjson_model.gh (Grasshopper 1.0.7)
# plug-ins: LadybugGrasshopper

path_to_hbjson = Panel("C:\Users\alejandro.s\AppData\Local\Building_urban_analysis\Scripts\long_wave_radiation_coupling\Ale\data\model_no_shade_win_not_el.hbjson")
falsestart = LBFalseStartToggle(True)
loadobjects = HBLoadObjects(hb_file=path_to_hbjson, load=falsestart)  # -> report, hb_objs; plug-in component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
vizbytype = HBVisualizeByType(hb_objs=loadobjects.hb_objs)  # -> walls, interior_walls, roofs, ceilings, exterior_floors, interior_floors, air_walls, apertures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; plug-in component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
vizbybc = HBVisualizeByBC(hb_objs=loadobjects.hb_objs)  # -> outdoors, surface, ground, adiabatic, other, wire_frame; plug-in component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
